# Grasshopper definition run_server.gh (Grasshopper 1.0.7)
# Copyright: Job de Vogel

panel = Panel("C:/Users/Job de Vogel/Documents/TU Delft/Building Technology/Core/code/hops")
ghpython_script = GhPythonScript(hops_dir=panel, run=Button())  # -> out
# ---------- ghpython_script: Python ----------
__author__ = "Job de Vogel"
__version__ = "2022.10.04"

from subprocess import Popen
import os.path

name = "/app.bat"
dir = hops_dir + name

if run:
    p = Popen(["cmd", "/K", dir])
    print('Server is running in cmd...')
# ---------- end ghpython_script ----------
