# Grasshopper definition FloorPlanGeometry.gh (Grasshopper 1.0.7)

panel = Panel("package module")
panel_2 = Panel("Plan 1")
panel_3 = Panel("other modules")
panel_4 = Panel("doors")
crv = Curve([<curve referenced from the Rhino model> x5])
pt = Point([<point referenced from the Rhino model> x12])
crv_2 = Curve(<curve referenced from the Rhino model>)

panel_6 = Panel("Plan 4")
crv_3 = Curve([<curve referenced from the Rhino model> x5])
crv_4 = Curve(<curve referenced from the Rhino model>)
pt_2 = Point([<point referenced from the Rhino model> x12])

panel_10 = Panel("Plan 2")
crv_5 = Curve(<curve referenced from the Rhino model>)
pt_3 = Point([<point referenced from the Rhino model> x6])
crv_6 = Curve(<curve referenced from the Rhino model>)

panel_13 = Panel("select site option")

panel_15 = Panel("Plan 5")
crv_7 = Curve([<curve referenced from the Rhino model> x3])
pt_4 = Point([<point referenced from the Rhino model> x7])
crv_8 = Curve(<curve referenced from the Rhino model>)

number_slider = Slider(4, range=0..4)

panel_19 = Panel("Plan 3")
crv_9 = Curve([<curve referenced from the Rhino model> x3])
crv_10 = Curve([<curve referenced from the Rhino model> x2])
pt_5 = Point([<point referenced from the Rhino model> x8])

entwine = Entwine(Branch00=crv, Branch01=crv_5, Branch02=crv_9, Branch03=crv_3, Branch04=crv_7, FlattenInputs=True)  # -> simplify(Result)
entwine_2 = Entwine(Branch00=crv_2, Branch01=crv_6, Branch02=crv_10, Branch03=crv_4, Branch04=crv_8, FlattenInputs=True)  # -> simplify(Result)
entwine_3 = Entwine(Branch00=pt, Branch01=pt_3, Branch02=pt_5, Branch03=pt_2, Branch04=pt_4, FlattenInputs=True)  # -> simplify(Result)
branch = TreeBranch(Tree=entwine, Path=number_slider, MaintainPaths=True)
branch_2 = TreeBranch(Tree=entwine_2, Path=number_slider, MaintainPaths=True)
branch_3 = TreeBranch(Tree=entwine_3, Path=number_slider, MaintainPaths=True)
pt_6 = Point(branch_3)
crv_11 = Curve(branch_2)
crv_12 = Curve(branch)
