# Grasshopper definition PackageOptimization.gh (Grasshopper 1.0.7)
# plug-ins: OpenNest, Moonlight, Human

# ---- group: Right-click > Set one file path
path = FilePath("C:\Users\hnrus\Downloads\amazon_boxes_only_dimensions.csv")

# ----
# Import .csv
panel = Panel(path)
file = ReadFile(File=path, PerLineParse=True)

# ----
# Determine grid
swatch = ColourSwatch(SwatchColor=RGB(255, 107, 107))
crv = Curve([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])
previewlw = CustomPreviewLineweights(Geometry=crv, Shader=swatch, Absolute=False)

# ---- group: Crate Definition
crate_y = Panel("""50
50
50""")
crate_z = Panel("""25
56
117""")
crate_x = Panel("""185
185
50""")

# ----
split = TextSplit(
    Text=["13,13,90", "23,15,9", "23,15,13", "23,17,6", "25,16,18", "25,18,8", "25,18,8", "25,18,13", "26,18,6", "16,30,41"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],
    Separators=",")

# ---- group: Crate Definition
weave = Weave(Pattern=[0, 1, 2], Stream0=crate_x, Stream1=crate_y, Stream2=crate_z, NullGaps=False)
partition = PartitionList(List=weave, Size=3)
crates = Data(partition)

# ----
lng = ListLength(List=crate_x)

# ---- group: Python Pipeline
modular = Slider(5, range=0..10)
pshift = ShiftPaths(Data=split, Offset=1)
python = GhPythonScript(boxes=pshift, modular=modular, crates=partition)  # -> out, simplify(box), simplify(box_mod); inputs boxes: tree, crates: tree
# ---------- python: Python ----------
__author__ = "jirri"
__version__ = "2022.10.03"

import math
import ghpythonlib.treehelpers as th


crates = th.tree_to_list(crates)
boxes = th.tree_to_list(boxes)

#Definition to replace math.prod because GHPython sucks
def prod(input):
    result = 1
    for x in input:
        result *= x
    return result

#Relative max error to crate size, to account for unit differences
max_error = float("inf")#int(prod(boxes[0])*1000)

#Initialize arrays (list of lists) to save data without appending 
crate_error_arr = [[] for i in range(len(boxes))]
orient_arr = [[] for i in range(len(boxes))]

#First, loop through all crates
for crate in crates:
    #Second, loop through all boxes
    for c, box in enumerate(boxes):
        indices = [1,2,0]
        #Third, loop through all orientations
        for orient in box:
            #Sort the index list for all orientations and order box appropriately
            indices.insert(0,indices.pop())
            box = [box[i] for i in indices]
            #Add all orientations to an array for later access
            orient_arr[c].append(box)
            #Check all three dimension values to see if it fits
            score = 0
            for i in range(0,3):
                if box[i] <= crate[i]:
                    score += 1
            #If this orientation fits: calculate the error , taking the modular system into account
            #Error is defined as: ((area in modular) * height of crate) - volume of box
            if score == 3:
                box_vol = prod(box)
                tot_vol = (math.ceil(box[0]/modular)*modular)*(math.ceil(box[1]/modular)*modular)*crate[2]
                error = int(tot_vol - box_vol)
                crate_error_arr[c].append(error)
            #If the orientation doesn't fit use the max_error
            else:
                crate_error_arr[c].append(max_error)

#With the errors established, the correct orientations can be sorted to their respective crates
crates_int = [0 for i in range(len(boxes))]
orient_int = [0 for i in range(len(boxes))]

#Loop over all errors to find the index of the best result, if no orientation fits -1 is used as index
for c, crate_error_list in enumerate(crate_error_arr):
    best_index = crate_error_list.index(min(crate_error_list))
    if crate_error_list[best_index] != max_error:
        #Recalculate the index to the smaller crate index
        best_crate = int(math.floor(best_index / 3))
        best_orient = best_index
    else:
        best_crate = -1
        best_orient = -1
    crates_int[c] = best_crate
    orient_int[c] = best_orient

#Using the index of the best crate and orientation, add these box dimensions to the output array
orient_out = [[] for i in range(len(crates))]
for c,orient in enumerate(orient_arr):
    crate_int = crates_int[c]
    if crate_int != -1:
        orient_out[crate_int].append(orient[orient_int[c]])

#Also output a version of the box list with dimensions rounded to the modular system
box_mod_out = [[] for i in range(len(crates))]
for c, i in enumerate(orient_out):
    for box in i:
        hold = [0,0,0]
        for d, j in enumerate(box):
            hold[d] = math.ceil(j/modular)*modular
        box_mod_out[c].append(hold)

print('Currently ' + str(crates_int.count(-1)) +'/'+str(len(boxes))+' boxes do not fit in any crate')
# print(crates_int)
# print(orient_out)
# print(box_mod_out)

box = th.list_to_tree(orient_out)
box_mod = th.list_to_tree(box_mod_out)
# ---------- end python ----------
panel_2 = Panel(python.out)

# ---- group: Data Preview
box = Panel(python.box)
box_mod = Panel(python.box_mod)

# ----
moonlight = Moonlight(Mode=Toggle(False))

# ----
# Reference plane max crate height
xy = XYPlane(Origin=Point(0, 0, 0))  # disabled
grid_size = Slider(140, range=0..200)  # disabled
height = Slider(100, range=0..150)  # disabled
number_of_cells = Slider(11, range=0..1000)  # disabled
recgrid = Rectangular(Plane=xy, SizeX=grid_size, SizeY=grid_size, ExtentX=number_of_cells, ExtentY=number_of_cells)  # -> Cells, flatten(Points); disabled
Z = UnitZ(Factor=height)  # disabled
move = Move(Geometry=recgrid.Cells, Motion=Z)  # -> Geometry, Transform; disabled
srf = Surface(move.Geometry)  # disabled

# ----
# Show boxes
item = ListItem(Index=0, Wrap=True)  # -> flatten(Item), flatten(Item1), flatten(Item2); disabled
lng_2 = ListLength(List=flatten(item.Item))  # disabled
Z_2 = UnitZ(Factor=item.Item2)  # disabled
split_2 = SplitList(List=recgrid.Points, Index=lng_2)  # -> ListA, ListB; disabled
pt = Point(split_2.ListA)  # disabled
box_2 = CenterBox(Base=pt, X=item.Item, Y=item.Item1, Z=item.Item2)  # disabled
move_2 = Move(Geometry=box_2, Motion=Z_2)  # -> Geometry, Transform; disabled

# ----
# Show min "box" size
relay = Relay()  # disabled
division = Division(B=relay)  # disabled
round = Round(Number=division)  # -> Nearest, Floor, Ceiling; disabled
multiplication = Multiplication(A=round.Ceiling, B=relay)  # disabled
dispatch = Dispatch(List=multiplication, DispatchPattern=[True, True, False])  # -> simplify(ListA), ListB; disabled
graft = GraftTree(IncludeEmptyLists=True, IncludeNullItems=True)  # -> simplify(Tree); disabled
weave_2 = Weave(Pattern=[0, 0, 1], Stream0=dispatch.ListA, Stream1=graft, NullGaps=False)  # disabled
item_2 = ListItem(List=weave_2, Index=0, Wrap=True)  # -> flatten(Item), flatten(Item1), flatten(Item2); disabled
Z_3 = UnitZ(Factor=item_2.Item2)  # disabled
box_3 = CenterBox(Base=pt, X=item_2.Item, Y=item_2.Item1, Z=item_2.Item2)  # disabled
swatch_2 = ColourSwatch(SwatchColor=RGB(119, 240, 96))  # disabled
move_3 = Move(Geometry=box_3, Motion=Z_3)  # -> Geometry, Transform; disabled

number_slider = Slider(114, range=0..117)  # disabled

# ---- group: Create Sheets
crates_2 = Data(crates)
item_3 = ListItem(List=crates_2, Index=0, Wrap=True)  # -> Item, Item1
rectangle = Rectangle(Plane=PlaneXY(0, 0, 0), XSize=item_3.Item, YSize=item_3.Item1, Radius=0)  # -> simplify(Rectangle), Length

# ---- group: Move Crate Groups
lng_3 = ListLength(List=flatten(rectangle.Rectangle))
series = Series(Start=0, Step=Slider(100, range=0..100), Count=lng_3)
neg = Negative(Value=series)
Y = UnitY(Factor=neg)  # -> graft(UnitVector)

# ----
# Volume packages
volume = Volume(Geometry=move_2.Geometry)  # -> Volume, Centroid; disabled

# ----
# Volume "boxes"
volume_2 = Volume(Geometry=move_3.Geometry)  # -> Volume, Centroid; disabled

panel_3 = Panel("0")  # disabled
equals = Equality(FirstNumber=volume_2.Volume, SecondNumber=panel_3)  # -> Equality, Inequality; disabled
dispatch_2 = Dispatch(List=move_3.Geometry, DispatchPattern=equals.Equality)  # -> ListA, ListB; disabled
dispatch_3 = Dispatch(List=move_2.Geometry, DispatchPattern=equals.Equality)  # -> ListA, ListB; disabled
dispatch_4 = Dispatch(List=volume.Volume, DispatchPattern=equals.Equality)  # -> ListA, ListB; disabled

# ----
# "Boxes"
geo = Geometry(dispatch_2.ListB)  # disabled

# ----
# Package too large
geo_2 = Geometry(dispatch_3.ListA)  # disabled

# ----
# Package not too large
geo_3 = Geometry(dispatch_3.ListB)  # disabled

swatch_3 = ColourSwatch(SwatchColor=RGB(255, 255, 255))  # disabled
preview = CustomPreview(Geometry=geo_3, Material=swatch_3)  # disabled

# ----
# Ground planes
debrep = DeconstructBrep(Brep=geo_3)  # -> Faces, Edges, Vertices; disabled
area = Area(Geometry=debrep.Faces)  # -> Area, Centroid; disabled
pdecon = Deconstruct(Point=area.Centroid)  # -> XComponent, YComponent, ZComponent; disabled
bnd = Bounds(Numbers=pdecon.ZComponent)  # disabled
dedomain = DeconstructDomain(Domain=bnd)  # -> Start, End; disabled
equals_2 = Equality(FirstNumber=dedomain.Start, SecondNumber=pdecon.ZComponent)  # -> Equality, Inequality; disabled
area_2 = Area(Geometry=debrep.Faces)  # -> Area, Centroid; disabled
dispatch_5 = Dispatch(List=debrep.Faces, DispatchPattern=equals_2.Equality)  # -> ListA, ListB; disabled
item_4 = ListItem(List=dispatch_5.ListA, Index=0, Wrap=True)  # disabled
geo_4 = Geometry(item_4)  # disabled

number_slider_2 = Slider(-280, range=-500..500)  # disabled
number_slider_3 = Slider(25, range=0..50)  # disabled

# ----
# Standard crate
number_slider_4 = Slider(50, range=0..200)  # disabled
number_slider_5 = Slider(50, range=0..200)  # disabled
number_slider_6 = Slider(50, range=0..50)  # disabled
number_slider_7 = Slider(100, range=0..100)  # disabled
rectangle_2 = Rectangle(Plane=PlaneXY(0, 0, 0), XSize=number_slider_4, YSize=number_slider_5, Radius=0)  # -> Rectangle, Length; disabled
Y_2 = UnitY(Factor=number_slider_2)  # disabled
move_4 = Move(Geometry=rectangle_2.Rectangle, Motion=Y_2)  # -> Geometry, Transform; disabled
Z_4 = UnitZ(Factor=[number_slider_3, number_slider_6, number_slider_7])  # disabled
extr = Extrude(Base=move_4.Geometry, Direction=Z_4)  # disabled
cap = CapHoles(Brep=extr)  # disabled

number_slider_8 = Slider(113, range=0..500)  # disabled
number_slider_9 = Slider(0, range=0..100)  # disabled
number_slider_10 = Slider(-280, range=-280..280)  # disabled
Y_3 = UnitY(Factor=number_slider_10)  # disabled
series_2 = Series(Start=number_slider_9, Step=number_slider_8, Count=3)  # disabled
X = UnitX(Factor=series_2)  # disabled
move_5 = Move(Geometry=move_4.Geometry, Motion=Y_3)  # -> Geometry, Transform; disabled
move_6 = Move(Geometry=cap, Motion=X)  # -> Geometry, Transform; disabled
area_3 = Area(Geometry=geo_4)  # -> Area, Centroid; disabled
area_4 = Area(Geometry=geo_4)  # -> Area, Centroid; disabled
panel_4 = Panel("1000000")  # disabled
panel_5 = Panel(area_3.Area)  # disabled
division_2 = Division(A=area_4.Area, B=panel_4)  # disabled
cp = ControlPoints(Curve=geo_4)  # -> Points, Weights, Knots; disabled
hull = ConvexHull(Points=cp.Points, Plane=PlaneXY(0, 0, 0))  # -> flatten(Hull), HullZ, Indices; disabled
opennest = OpenNest(
    Sheets=move_5.Geometry,
    Geo=hull.Hull,
    Spacing=1,
    Placement=1,
    Tolerance=0.1,
    Rotations=4,
    Iterations=1,
    Seed=1,
    Reset=True,
    Run=False)  # -> Sheets, Geo, ID, Transform, IDS
geo_5 = Geometry(hull.Hull)  # disabled
panel_6 = Panel(opennest.IDS)  # disabled
geo_6 = Geometry(opennest.Geo)  # disabled
multiplication_2 = Multiplication(A=number_slider_4, B=number_slider_5)  # disabled
area_5 = Area(Geometry=geo_5)  # -> Area, Centroid; disabled
larger = LargerThan(FirstNumber=area_5.Area, SecondNumber=multiplication_2)  # -> LargerThan, OrEqualTo; disabled
dispatch_6 = Dispatch(List=geo_5, DispatchPattern=larger.LargerThan)  # -> ListA, ListB; disabled
lng_4 = ListLength(List=dispatch_6.ListA)  # disabled
lng_5 = ListLength(List=dispatch_6.ListB)  # disabled
panel_7 = Panel(lng_5)  # disabled
panel_8 = Panel(lng_4)  # disabled

# ---- group: Random Selection Generator
# graph mapper will add a weighted package split,
# so more packages are small
no_boxes = Slider(300, range=0..1000)
no_crates = Integer(lng)
dom = ConstructDomain(DomainStart=0, DomainEnd=no_boxes)
num = Number(1)

# ----
subtraction = Subtraction(A=no_crates, B=1)

# ---- group: Random Selection Generator (continued)
random = Random(Range=Domain(0, 1), Number=subtraction, Seed=2, Integers=False)
sort = SortList(Keys=random)  # -> Keys, ValuesA
graph = GraphMapper(sort.Keys, x0=0, x1=1, y0=0, y1=1, Cx=0.3154279292, Cy=0.6982121468, container_name="Conic")

# ----
entwine = Entwine(Branch00=graph, Branch01=num, FlattenInputs=True)  # -> flatten(Result)

# ---- group: Random Selection Generator (continued)
remap = RemapNumbers(Value=entwine, Source=Domain(0, 1), Target=dom)  # -> Mapped, Clipped
int = Integer(remap.Mapped)
item_5 = ListItem(List=int, Index=0, Wrap=True)
reldif = RelativeDifferences(Values=int)
item_6 = ListItem(List=reldif, Index=0, Wrap=True)  # -> Item, Item1, Item2
merge = Merge(Data1=item_5, Data2=item_6.Item1, Data3=item_6.Item2)

# ----
box_mod_2 = Data(python.box_mod)
item_7 = ListItem(List=box_mod_2, Index=0, Wrap=True)  # -> Item, Item1, Item2
rectangle_3 = Rectangle(Plane=PlaneXY(0, 0, 0), XSize=item_7.Item, YSize=item_7.Item1, Radius=0)  # -> Rectangle, Length
trim = TrimTree(Tree=rectangle_3.Rectangle, Depth=1)
rectangles_prepick = Rectangle(trim)
rectangles = Rectangle(trim)

rectangles_prepick_2 = Rectangle(rectangles_prepick)
lng_6 = ListLength(List=rectangles_prepick_2)
dom_2 = ConstructDomain(DomainStart=0, DomainEnd=lng_6)  # -> flatten(Domain)

# ---- group: Random Selection Generator (continued)
random_2 = Random(Range=dom_2, Number=merge, Seed=2, Integers=True)

# ---- group: Create Display Grid
rectangles_2 = Rectangle(graft(rectangles_prepick))
y_offset_start = Slider(100, range=0..1000)
grid_size_2 = Slider(150, range=0..150)
lng_7 = ListLength(List=flatten(rectangles_2))
sqrt = SquareRoot(Value=lng_7)
xy_2 = XYPlane(Origin=Point(0, 0, 0))
Y_4 = UnitY(Factor=y_offset_start)
rectangle_4 = Rectangle(Plane=PlaneXY(0, 0, 0), XSize=grid_size_2, YSize=grid_size_2, Radius=0)  # -> Rectangle, Length
round_2 = Round(Number=sqrt)  # -> Nearest, Floor, Ceiling
move_7 = Move(Geometry=xy_2, Motion=Y_4)  # -> Geometry, Transform
arrrec = RectangularArray(Geometry=move_7.Geometry, Cell=rectangle_4.Rectangle, XCount=round_2.Ceiling, YCount=round_2.Ceiling)  # -> Geometry, Transform
lng_8 = ListLength(List=arrrec.Geometry)
subtraction_2 = Subtraction(A=lng_8, B=lng_7)
series_3 = Series(Start=0, Step=1, Count=subtraction_2)
cull_i = CullIndex(List=reverse(arrrec.Geometry), Indices=series_3, Wrap=True)  # -> reverse(graft(List))
match = MatchTree(Tree=cull_i, Guide=rectangles_2)
trim_2 = TrimTree(Tree=match, Depth=1)
display_plane = Plane(trim_2)

# ----
trim_3 = TrimTree(Tree=item_7.Item2, Depth=1)

height_2 = Number(trim_3)

# ---- group: Select Random Packages
item_8 = ListItem(List=trim, Index=random_2, Wrap=True)
rectangles_3 = Rectangle(item_8)

# ---- group: Choose to use random selection
use_random_sel = BooleanToggle(False)
filter = StreamFilter(Gate=use_random_sel, Stream0=rectangles, Stream1=rectangles_3)

# ---- group: 3D for display
rectangles_4 = Data(filter)
height_3 = Number(height_2)
display_plane_2 = Plane(display_plane)
boxrec = BoxRectangle(Rectangle=rectangles_4, Height=height_3)
orient = Orient(Geometry=boxrec, Source=PlaneXY(0, 0, 0), Target=display_plane_2)  # -> Geometry, Transform
box_base = Geometry(boxrec)
geo_7 = Geometry(orient.Geometry)

# ---- group: Display Rectangle
display_plane_3 = Plane(display_plane)
rectangles_5 = Data(filter)
orient_2 = Orient(Geometry=rectangles_5, Source=PlaneXY(0, 0, 0), Target=display_plane_3)  # -> Geometry, Transform
crv_2 = Curve(orient_2.Geometry)

# ---- group: Activate packing calculation
# Save before use
# and you'd better not be moving
# any sliders when enabled
gate = StreamGate(Stream=filter, Gate=Toggle(True))  # -> Target0, Target1
dam = DataDam(DataA=gate.Target1, BufferDelay=10000000, BufferMode=0)

# ---- group: No of Packages per Crate type
viewer = ParamViewer(filter)

# ---- group: Create Geo and Sheets
rectangles_6 = Rectangle(dam)
rectangles_7 = Curve(rectangles_6)
tolerance_scale = Slider(0.99, range=0..1)
area_6 = Area(Geometry=rectangles_7, UseTasks=False)  # -> Area, Centroid
scale = Scale(Geometry=rectangles_7, Center=area_6.Centroid, Factor=tolerance_scale)  # -> Geometry, Transform

# ----
opennest_2 = OpenNest(
    Sheets=rectangle.Rectangle,
    Geo=scale.Geometry,
    Spacing=0,
    Placement=1,
    Tolerance=1,
    Rotations=4,
    Iterations=2,
    Seed=1,
    Reset=Button(),
    Run=Toggle(False))  # -> Sheets, Geo, ID, Transform, IDS

# ---- group: Non fitting Error check
expression = Expression(x=opennest_2.IDS, Expression="If(x=-1,1,0)")
ma = MassAddition(Input=expression)  # -> Result, PartialResults
panel_9 = Panel(ma.Result)

# ---- group: Upscaling from 99%
dematrix = DeconstructMatrix(Matrix=simplify(opennest_2.Transform))  # -> Rows, Columns, Values
modular_2 = Number(modular)
panel_10 = Panel("""0
0
0
1
0
0
0
1
0
0
0
0
0
0
0
0""")
sift = SiftPattern(List=dematrix.Values, SiftPattern=panel_10)  # -> Output0, Output1
division_3 = Division(A=modular_2, B=2)
division_4 = Division(A=sift.Output1, B=division_3)
round_3 = Round(Number=division_4)  # -> Nearest, Floor, Ceiling
multiplication_3 = Multiplication(A=round_3.Ceiling, B=division_3)
combine = CombineData(Input0=sift.Output0, Input1=multiplication_3)  # -> Result, Index
matrix = ConstructMatrix(Rows=dematrix.Rows, Columns=dematrix.Columns, Values=simplify(combine.Result))
lng_9 = ListLength(List=opennest_2.Transform)  # -> flatten(Length)
item_9 = ListItem(List=matrix, Index=0, Wrap=True)
partition_2 = PartitionList(List=flatten(item_9), Size=lng_9)

# ---- group: Sheets
move_8 = Move(Geometry=opennest_2.Sheets, Motion=Y)  # -> Geometry, Transform

# ---- group: No of Crates per type
viewer_2 = ParamViewer(move_8.Geometry)

# ----
matrix_2 = TransformMatrix(opennest_2.Transform, Digits=3)

# ---- group: Fitted Geo
box_base_2 = Geometry(box_base)
transform = Transform(Geometry=box_base_2, Transform=partition_2)
move_9 = Move(Geometry=transform, Motion=Y)  # -> Geometry, Transform

transform_2 = Transform(Geometry=rectangles_7, Transform=partition_2)
move_10 = Move(Geometry=transform_2, Motion=Y)  # -> Geometry, Transform
