# Grasshopper definition ProgramPlacement.gh (Grasshopper 1.0.7)
# plug-ins: Hops, LunchBox

# ----
# GH generated data for testing
panel = Panel("use")
panel_2 = Panel("length")
panel_3 = Panel("width")
panel_4 = Panel("height")
panel_5 = Panel("module mask")
panel_6 = Panel("layer")
panel_7 = Panel("packages")
panel_8 = Panel("3")
panel_9 = Panel("1,0")
panel_10 = Panel("P1: Packages")
panel_11 = Panel("create module geometry")
xy = XYPlane(Origin=Point(0, 0, 0))
rectangle = Rectangle(Plane=xy, XSize="4", YSize="7", Radius=0)  # -> Rectangle, Length
boundary = BoundarySurfaces(Edges=rectangle.Rectangle)

panel_12 = Panel("use")
panel_18 = Panel("improtance")
panel_20 = Panel("P2: Bikes")
xy_2 = XYPlane(Origin=Point(0, 0, 0))
rectangle_2 = Rectangle(Plane=xy_2, XSize="3", YSize="3", Radius=0)  # -> Rectangle, Length
boundary_2 = BoundarySurfaces(Edges=rectangle_2.Rectangle)

panel_30 = Panel("P3: GreenWalls")
xy_3 = XYPlane(Origin=Point(0, 0, 0))
rectangle_3 = Rectangle(Plane=xy_3, XSize="1", YSize="3", Radius=0)  # -> Rectangle, Length
boundary_3 = BoundarySurfaces(Edges=rectangle_3.Rectangle)

panel_32 = Panel("plot")
panel_33 = Panel("Site Option 0")
panel_34 = Panel("road")
panel_35 = Panel("sidewalk")
panel_36 = Panel("nearby buildings")
panel_37 = Panel("landmarks")
panel_38 = Panel("views")
brep = Brep([<brep referenced from the Rhino model> x3])
pt = Point([<point referenced from the Rhino model> x3])
pt_2 = Point(<point referenced from the Rhino model>)
pt_3 = Point(<point referenced from the Rhino model>)
srf = Surface(<surface referenced from the Rhino model>)
line = Line(Line((-2.751304186, -2.172082252, 0), (12.74288255, -2.172082252, 0)))
line_2 = Line([Line((-2.751304186, -0.9774370135, 0), (12.74288255, -0.9774370135, 0)), Line((11.58443868, -0.9774370135, 0), (11.58443868, 11.83784827, 0))])

panel_41 = Panel("Site Option 1")
brep_2 = Brep([<brep referenced from the Rhino model> x3])
pt_4 = Point([<point referenced from the Rhino model> x3])
pt_5 = Point(<point referenced from the Rhino model>)
pt_6 = Point(<point referenced from the Rhino model>)
srf_2 = Surface(<surface referenced from the Rhino model>)
line_3 = Line(Line((-2.530973154, 12.83819242, 0), (13.57880973, 12.83819242, 0)))
line_4 = Line(Line((-2.587269307, 11.91638794, 0), (13.40337934, 11.91638794, 0)))

panel_50 = Panel("module geometry")
panel_51 = Panel("importance")
merge = Merge(Data1="bikes", Data2="green_wall")
merge_2 = Merge(Data1="1,1", Data2="0,0")
merge_3 = Merge(Data1=boundary_2, Data2=boundary_3)
panel_52 = Panel(merge)
panel_53 = Panel(merge_2)
panel_54 = Panel(merge_3)
merge_4 = Merge(Data1="2", Data2="1")  # -> flatten(Result)
panel_55 = Panel(merge_4)

# ----
# !!!run hops server to use custom nodes!!!
# Open the code in visual studio
# Navigate to unpack > hops > app.py and double click the file to open
# Press the play button in the upper right corner
# 
# Close this file and close Rhino
# Open Rhino and Grasshopper file
# number of modules to place
panel_56 = Panel("select site option")
# navigate to excel file with module information
panel_57 = Panel("flask server address")
panel_58 = Panel("grid size")
number_slider = Slider(0, range=0..1)
path = FilePath("C:\Users\lisam\OneDrive\!_TU Delft\22_0905 Q1\AR3B012 CORE\ProgrammePlacement\Modules.xlsx")
number_slider_2 = Slider(3, range=0..3)

entwine = Entwine(Branch00=line, Branch01=line_3, FlattenInputs=True)  # -> simplify(Result)
entwine_2 = Entwine(Branch00=srf, Branch01=srf_2, FlattenInputs=True)  # -> simplify(Result)
entwine_3 = Entwine(Branch00=line_2, Branch01=line_4, FlattenInputs=True)  # -> simplify(Result)
entwine_4 = Entwine(Branch00=brep, Branch01=brep_2, FlattenInputs=True)  # -> simplify(Result)
entwine_5 = Entwine(Branch00=pt_2, Branch01=pt_5, FlattenInputs=True)  # -> simplify(Result)
entwine_6 = Entwine(Branch00=pt, Branch01=pt_4, FlattenInputs=True)  # -> simplify(Result)
entwine_7 = Entwine(Branch00=pt_3, Branch01=pt_6, FlattenInputs=True)  # -> simplify(Result)
branch = TreeBranch(Tree=entwine, Path=number_slider, MaintainPaths=True)
branch_2 = TreeBranch(Tree=entwine_2, Path=number_slider, MaintainPaths=True)
branch_3 = TreeBranch(Tree=entwine_3, Path=number_slider, MaintainPaths=True)
branch_4 = TreeBranch(Tree=entwine_4, Path=number_slider, MaintainPaths=True)
branch_5 = TreeBranch(Tree=entwine_5, Path=number_slider, MaintainPaths=True)
branch_6 = TreeBranch(Tree=entwine_6, Path=number_slider, MaintainPaths=True)
branch_7 = TreeBranch(Tree=entwine_7, Path=number_slider, MaintainPaths=True)
path_mapper = PathMapper(branch, source="{A}", target="{0}")
path_mapper_2 = PathMapper(branch_3, source="{A}", target="{0}")
path_mapper_3 = PathMapper(branch_7, source="{A}", target="{0}")
path_mapper_4 = PathMapper(branch_5, source="{A}", target="{0}")
path_mapper_5 = PathMapper(branch_6, source="{A}", target="{0}")
path_mapper_6 = PathMapper(branch_2, source="{A}", target="{0}")
path_mapper_7 = PathMapper(branch_4, source="{A}", target="{0}")

panel_59 = Panel("context")
preview = CustomPreview(
    Geometry=[branch_2, branch, branch_3, branch_6, branch_5, branch_7, branch_4],
    Material=ColourSwatch(SwatchColor=RGBA(178, 178, 178, 142)))

# ----
# distance to road, distance to sidewalk, sun hours, nearby buildings, distance to landmark, distance to view
panel_60 = Panel("cost function")

# ----
# extract module adjacency data from excel
toggle = BooleanToggle(True)
toggle_2 = BooleanToggle(True)
excelread = ExcelReader(ReadExcelData=toggle, WorkbookPath=path, WorksheetName="AdjacencyList")  # -> Exceptions, ExcelData
cull_i = CullIndex(List=excelread.ExcelData, Indices="0", Wrap=True)
num = Number(cull_i)
clean = CleanTree(RemoveNulls=toggle_2, RemoveInvalid=toggle_2, RemoveEmpty=toggle_2, Tree=num)
lng = ListLength(List=clean)
item = ListItem(List=flatten(lng), Index=0, Wrap=True)
subtraction = Subtraction(A=item, B=1)
dom = ConstructDomain(DomainStart="0", DomainEnd=subtraction)
subset = SubList(List=cull_i, Domain=dom, Wrap=True)  # -> simplify(List), Index
panel_61 = Panel("""{0} headings
{1} packages
{2} services
{3} bikes
{4} bottle_return
{5} cafe
{6} droid_port
{7} fab_lab
{8} flitz
{9} green_wall
{10} groceries
{11} huel_bar
{12} medicine_pickup""")
bang = ExplodeTree(Data=subset.List)  # -> Branch0, Branch1, Branch2, Branch3, Branch4, Branch5, Branch6, Branch7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

# ----
# extract module data from excel
toggle_3 = BooleanToggle(True)
toggle_4 = BooleanToggle(True)
excelread_2 = ExcelReader(ReadExcelData=toggle_3, WorkbookPath=path, WorksheetName="ModuleList")  # -> Exceptions, ExcelData
cull_i_2 = CullIndex(List=excelread_2.ExcelData, Indices="0", Wrap=True)
num_2 = Number(cull_i_2)
clean_2 = CleanTree(RemoveNulls=toggle_4, RemoveInvalid=toggle_4, RemoveEmpty=toggle_4, Tree=num_2)
lng_2 = ListLength(List=clean_2)
item_2 = ListItem(List=flatten(lng_2), Index=0, Wrap=True)
subtraction_2 = Subtraction(A=item_2, B=1)
dom_2 = ConstructDomain(DomainStart="0", DomainEnd=subtraction_2)
subset_2 = SubList(List=cull_i_2, Domain=dom_2, Wrap=True)  # -> List, Index

panel_62 = Panel("""{0} use
{1} length
{2} width
{3} height
{4} module mask
{5} layer
{6} importance
{7} door""")
bang_2 = ExplodeTree(Data=subset_2.List)  # -> Branch0, Branch1, Branch2, Branch3, Branch4, Branch5, Branch6, Branch7

split = SplitList(List=bang_2.Branch6, Index=2)  # -> ListA, ListB
jitter = Jitter(List=split.ListB, Jitter=1, Seed="200")  # -> Values, Indices
ins = InsertItems(List=jitter.Values, Item=split.ListA, Indices=0, Wrap=True)
panel_63 = Panel(ins)
txt = Text(bang_2.Branch6)

panel_64 = Panel("door points")
sort = SortList(Keys=txt, ValuesA=bang_2.Branch7)  # -> Keys, ValuesA

xy_4 = XYPlane(Origin=Point(0, 0, 0))
rectangle_4 = Rectangle(Plane=xy_4, XSize=bang_2.Branch1, YSize=bang_2.Branch2, Radius=0)  # -> Rectangle, Length
panel_66 = Panel("sorted surfaces")
boundary_4 = BoundarySurfaces(Edges=rectangle_4.Rectangle)
sort_2 = SortList(Keys=txt, ValuesA=boundary_4)  # -> Keys, ValuesA

panel_67 = Panel(jitter.Values)

panel_68 = Panel("sorted use")
sort_3 = SortList(Keys=txt, ValuesA=bang_2.Branch0)  # -> Keys, ValuesA

sort_4 = SortList(Keys=txt, ValuesA=bang_2.Branch4)  # -> Keys, ValuesA

# ----
# A: package module
# B: all other modules (sorted by priority)
# DUE TO LIMITATIONS WITH HOPS:
# ALL TREE INPUTS MUST BE SIMPLIFIED TREE STRUCTURE {0}, {1}, {2} etc,
# SURFACES MUST BE IN FLATTENED LIST
# ALL TREE INPUTS MUST BE SIMPLIFIED TREE STRUCTURE {0}, {1}, {2} etc,
# ALL TREE INPUTS MUST BE SIMPLIFIED TREE STRUCTURE {0}, {1}, {2} etc,
dom_3 = ConstructDomain(DomainStart=0, DomainEnd=number_slider_2)
panel_70 = Panel("format data")
split_2 = SplitList(List=sort.ValuesA, Index="1")  # -> simplify(ListA), simplify(ListB)
split_3 = SplitList(List=sort_3.ValuesA, Index="1")  # -> simplify(ListA), simplify(ListB)
split_4 = SplitList(List=sort_4.ValuesA, Index="1")  # -> simplify(ListA), simplify(ListB)
split_5 = SplitList(List=sort_2.ValuesA, Index="1")  # -> simplify(ListA), simplify(flatten(ListB))
subset_3 = SubList(List=split_2.ListB, Domain=dom_3, Wrap=True)  # -> simplify(graft(List)), Index
subset_4 = SubList(List=split_3.ListB, Domain=dom_3, Wrap=True)  # -> simplify(graft(List)), Index
subset_5 = SubList(List=split_5.ListB, Domain=dom_3, Wrap=True)  # -> simplify(flatten(List)), Index
subset_6 = SubList(List=split_4.ListB, Domain=dom_3, Wrap=True)  # -> simplify(graft(List)), Index

# ----
# colours to match project color code
panel_71 = Panel("""229
197
26
133
161
255
91
72
76
151
142""")
panel_72 = Panel("""79
218
37
145
42
255
8
84
76
181
160""")
panel_73 = Panel("""255
130
18
73
250
228
202
63
230
53
128""")
entwine_8 = Entwine(Branch00=panel_73, Branch01=panel_71, Branch02=panel_72, FlattenInputs=True)
dom_4 = ConstructDomain(DomainStart=0, DomainEnd=number_slider_2)
subset_7 = SubList(List=entwine_8, Domain=dom_4, Wrap=True)  # -> simplify(List), Index
bang_3 = ExplodeTree(Data=subset_7.List)  # -> Branch0, Branch1, Branch2
rgb = ColourRGB(Alpha=255, Red=bang_3.Branch0, Green=bang_3.Branch1, Blue=bang_3.Branch2)

panel_74 = Panel(dom_3)

# ----
# fix bug with tree structure when certain inputs are set to 0
tstat = TreeStatistics(Tree=subset_4.List)  # -> Paths, Length, Count
tstat_2 = TreeStatistics(Tree=subset_5.List)  # -> Paths, Length, Count
tstat_3 = TreeStatistics(Tree=subset_3.List)  # -> Paths, Length, Count
tstat_4 = TreeStatistics(Tree=subset_6.List)  # -> Paths, Length, Count
item_3 = ListItem(List=tstat.Paths, Index=0, Wrap=True)
item_4 = ListItem(List=tstat_2.Paths, Index=0, Wrap=True)
item_5 = ListItem(List=tstat_3.Paths, Index=0, Wrap=True)
item_6 = ListItem(List=tstat_4.Paths, Index=0, Wrap=True)
dpath = DeconstructPath(Branch=item_3)
dpath_2 = DeconstructPath(Branch=item_4)
dpath_3 = DeconstructPath(Branch=item_5)
dpath_4 = DeconstructPath(Branch=item_6)
lng_3 = ListLength(List=flatten(dpath))
lng_4 = ListLength(List=flatten(dpath_2))
lng_5 = ListLength(List=flatten(dpath_3))
lng_6 = ListLength(List=flatten(dpath_4))
subtraction_3 = Subtraction(A=lng_3, B=1)
subtraction_4 = Subtraction(A=lng_4, B=1)
subtraction_5 = Subtraction(A=lng_5, B=1)
subtraction_6 = Subtraction(A=lng_6, B=1)
pshift = ShiftPaths(Data=subset_4.List, Offset=subtraction_3)
pshift_2 = ShiftPaths(Data=subset_5.List, Offset=subtraction_4)
pshift_3 = ShiftPaths(Data=subset_3.List, Offset=subtraction_5)
pshift_4 = ShiftPaths(Data=subset_6.List, Offset=subtraction_6)

# ----
# DUE TO LIMITATIONS WITH HOPS:
# ALL TREE INPUTS MUST BE SIMPLIFIED TREE STRUCTURE {0}, {1}, {2} etc, this node only accepts 2D trees
data = Data(pshift)
data_2 = Data(pshift_2)
data_3 = Data(pshift_4)

epw_url = Panel("https://energyplus-weather.s3.amazonaws.com/europe_wmo_region_6/NLD/NLD_Amsterdam.062400_IWEC/NLD_Amsterdam.062400_IWEC.zip")
downloadepw = LBDownloadWeather(weather_URL=epw_url)  # -> epw_file, stat_file, ddy_file; plug-in component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
importepw = LBImportEPW(epw_file=downloadepw.epw_file)  # -> location, dry_bulb_temperature, dew_point_temperature, relative_humidity, wind_speed, wind_direction, direct_normal_rad, diffuse_horizontal_rad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; plug-in component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
month = Slider(1, range=1..12)
hour = Slider(20, range=0..100)
day = Slider(21, range=0..100)
hour_2 = Slider(8, range=0..100)
month_2 = Slider(12, range=1..12)
day_2 = Slider(21, range=0..100)
analysisperiod = LBAnalysisPeriod(start_month=month, start_day=day, start_hour=hour_2, end_month=month_2, end_day=day_2, end_hour=hour)  # -> period, hoys, dates; plug-in component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
debrep = DeconstructBrep(Brep=srf)  # -> Faces, Edges, Vertices
sunpath = LBSunPath(location=importepw.location, hoys=analysisperiod.hoys, scale=1)  # -> out, vectors, altitudes, azimuths, hoys, sun_pts, analemma, daily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; plug-in component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
item_7 = ListItem(List=debrep.Vertices, Index=0, Wrap=True)  # -> Item, Item1, Item2
dist = Distance(PointA=item_7.Item, PointB=item_7.Item1)
dist_2 = Distance(PointA=item_7.Item1, PointB=item_7.Item2)
run_the_calculation = BooleanToggle(True)
division = Division(A=dist, B="1")
division_2 = Division(A=dist_2, B="1")

# ----
# DUE TO LIMITATIONS WITH HOPS:
# Nearby Buildings, Landmarks, and Views must be entwined into one data tree with three simplified branches
get_point = GetPoint(path_mapper_5, AtLeast=1, AtMost=1, Realtime=True, TreeAccess=False)
get_point_2 = GetPoint(path_mapper_4, AtLeast=1, AtMost=1, Realtime=True, TreeAccess=False)
get_point_3 = GetPoint(path_mapper_3, AtLeast=1, AtMost=1, Realtime=True, TreeAccess=False)
panel_75 = Panel("results from ladybug")
get_geometry = GetGeometry(path_mapper_7, AtLeast=1, AtMost=1, DeleteInput=False, Filter=1074004029, TreeAccess=False)
entwine_9 = Entwine(Branch00=get_point, Branch01=get_point_2, Branch02=get_point_3, FlattenInputs=True)  # -> simplify(Result)
get_geometry_2 = GetGeometry(path_mapper_6, AtLeast=1, AtMost=1, DeleteInput=False, Filter=1074004029, TreeAccess=False)
get_line = GetLine(path_mapper, AtLeast=1, AtMost=1, Realtime=True, TreeAccess=False)
get_line_2 = GetLine(path_mapper_2, AtLeast=1, AtMost=1, Realtime=True, TreeAccess=False)
get_integer = GetInteger("1", AtLeast=1, AtMost=1, Maximum=2147483647, Minimum=-2147483648, TreeAccess=False)
concat = Concatenate(FragmentA="http://127.0.0.1:5000", FragmentB="/dividesite")

directsunhours = LBDirectSunHours(
    vectors=flatten(sunpath.vectors),
    geometry=flatten(get_geometry_2),
    context=flatten(get_geometry),
    grid_size="1",
    run=run_the_calculation)  # -> out, points, results, mesh, legend, title, int_mtx; plug-in component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
reorder_lb_results = GhPythonScript(data=directsunhours.results, site_length=division, site_width=division_2, step="1")  # -> out, formated_data; inputs data: list
# ---------- reorder_lb_results: Python ----------
"""Provides a scripting component.
    Inputs:
        data: The analysis information to reorder
        site length: The dimension of the site (along the Y axis)
    Output:
        formated_data: Ladybug data formated to match pointgrid"""

__author__ = "lisam"
__version__ = "2022.10.23"

import rhinoscriptsyntax as rs
import ghpythonlib.treehelpers as th

formated_data_list = []

for i in range(int(site_length)):
    row_list = []
    for j in range(i, int(site_width)*int(site_length)+i, int(site_length)):
        row_list.append(data[j])
        if j + int(site_length) == int(site_width)*int(site_length)+i:
            row_list.append(data[j])
    formated_data_list.append(row_list)
    if i == int(site_length)-int(step):
        formated_data_list.append(row_list)

formated_data = th.list_to_tree(formated_data_list)
# ---------- end reorder_lb_results ----------

int = Integer(simplify(reorder_lb_results.formated_data))

hops = Hops(
    _Path=concat,
    Geometry=get_geometry_2,
    RoadLines=get_line,
    SidewalkLines=get_line_2,
    Integer=get_integer,
    ContextPointS=entwine_9,
    SunAnalysis=int,
    CacheResultsInMemory=False,
    CacheSolveResults=False,
    RemoteDefinitionLocation="http://127.0.0.1:5000/dividesite",
    RemoteSolveVersion=(0, 1, 0),
    ShowInput_Enabled=False,
    ShowInput_Path=True,
    SynchronousSolve=True)  # -> Points, Cost, Lables
panel_76 = Panel(hops.Points)
panel_77 = Panel(hops.Lables)
panel_78 = Panel(hops.Cost)

# ----
# s - site
# e - site edge
# b - boundary of structure
# i - interior
# o - outside site
# x - door
panel_79 = Panel("lables")
data_4 = Data(hops.Lables)

panel_80 = Panel("cost function")
data_5 = Data(hops.Cost)

panel_81 = Panel("point grid")
pt_7 = Point(hops.Points)

# ----
# analysis and placement of package module
panel_82 = Panel("/placepackages")
data_6 = Data(split_4.ListA)
data_7 = Data(split_3.ListA)
data_8 = Data(split_5.ListA)
concat_2 = Concatenate(FragmentA="http://127.0.0.1:5000", FragmentB=panel_82)
hops_2 = Hops(
    _Path=concat_2,
    Points=pt_7,
    Cost=data_5,
    Lables=data_4,
    ModuleUse=data_7,
    ModuleGeometry=data_8,
    ModuleMask=data_6,
    Door=split_2.ListA,
    CacheResultsInMemory=False,
    CacheSolveResults=False,
    RemoteDefinitionLocation="http://127.0.0.1:5000/placepackages",
    RemoteSolveVersion=(0, 1, 0),
    ShowInput_Enabled=False,
    ShowInput_Path=True,
    SynchronousSolve=True)  # -> Surface, Cost, ModuleGridEdges, Lables

circle = CircleCNR(Center=pt_7, Normal=Vector(0, 0, 1), Radius=".05")
boundary_5 = BoundarySurfaces(Edges=circle)
panel_83 = Panel("grid points")
preview_2 = CustomPreview(Geometry=boundary_5, Material=ColourSwatch(SwatchColor=RGBA(0, 0, 0, 142)))

panel_84 = Panel("edge points")
pt_8 = Point(hops_2.ModuleGridEdges)

# ----
# optimally placed package module
srf_3 = Surface(hops_2.Surface)
preview_3 = CustomPreview(Geometry=srf_3, Material=ColourSwatch(SwatchColor=RGB(201, 8, 8)))

tag = TextTag3D(Location=pt_7, Text=hops_2.Cost, Size="0.1", Justification=7)

# ----
# s - site
# e - site edge
# b - boundary of structure
# i - interior
# o - outside site
# x - door
panel_85 = Panel("lables")
data_9 = Data(hops_2.Lables)

data_10 = Data(hops_2.Cost)

panel_87 = Panel(hops_2.Lables)

# ----
# analysis and placement of rest of modules
panel_88 = Panel("/placemodules")
concat_3 = Concatenate(FragmentA="http://127.0.0.1:5000", FragmentB=panel_88)
hops_3 = Hops(
    _Path=concat_3,
    Points=pt_7,
    Cost=data_5,
    Lables=data_9,
    ModuleUse=data,
    ModuleGeometryAsFlattenedList=data_2,
    ModuleMask=data_3,
    Doors=pshift_3,
    CacheResultsInMemory=False,
    CacheSolveResults=False,
    RemoteDefinitionLocation="http://127.0.0.1:5000/placemodules",
    RemoteSolveVersion=(0, 1, 0),
    ShowInput_Enabled=False,
    ShowInput_Path=True,
    SynchronousSolve=True)  # -> Surface, ModuleGridEdges, Lables

tag_2 = TextTag3D(Location=pt_7, Size="0.1", Justification=7)

srf_4 = Surface(hops_3.Surface)
panel_89 = Panel("optimally placed modules")
preview_4 = CustomPreview(Geometry=srf_4, Material=rgb)

pt_9 = Point(hops_3.ModuleGridEdges)

# ----
# s - site
# e - site edge
# b - boundary of structure
# i - interior
# o - outside site
# x - door
panel_91 = Panel("lables")
data_11 = Data(hops_3.Lables)

# ----
# extract points representing each type of point
# convert labels to points and output them
panel_92 = Panel("/labelstopoints1")
pt_10 = Point(pt_7)
data_12 = Data(hops_3.Lables)
concat_4 = Concatenate(FragmentA="http://127.0.0.1:5000", FragmentB=panel_92)
hops_4 = Hops(
    _Path=concat_4,
    Points=pt_10,
    Lables=data_12,
    CacheResultsInMemory=True,
    CacheSolveResults=True,
    RemoteDefinitionLocation="http://127.0.0.1:5000/labelstopoints1",
    RemoteSolveVersion=(0, 1, 0),
    ShowInput_Enabled=False,
    ShowInput_Path=True,
    SynchronousSolve=True)  # -> SitePoints, SiteEdgePoints, StructureBoundaryPoints, StructureInteriorPoints, DoorPoints, PointsOutsideOfSite

panel_93 = Panel("door")
pt_11 = Point(hops_4.DoorPoints)

panel_94 = Panel("interior")
pt_12 = Point(hops_4.StructureInteriorPoints)

panel_95 = Panel("outside site")
pt_13 = Point(hops_4.PointsOutsideOfSite)

panel_96 = Panel("boundaries")
pt_14 = Point(hops_4.StructureBoundaryPoints)

# ----
# surfaced of each module
srf_5 = Surface(hops_3.Surface)

pt_15 = Point(hops_4.SiteEdgePoints)
panel_97 = Panel("edges")

pt_16 = Point(hops_4.SitePoints)
panel_98 = Panel("site")

panel_99 = Panel("hops output")
pt_17 = Point(pt_16)
pt_18 = Point(pt_15)
pt_19 = Point(pt_12)
srf_6 = Surface(srf_5)
pt_20 = Point(pt_14)
pt_21 = Point(pt_11)
pt_22 = Point(pt_13)

edges = BrepEdges(Brep=srf_5)  # -> Naked, Interior, NonManifold

circle_2 = CircleCNR(Center=pt_14, Normal=Vector(0, 0, 1), Radius=".1")
boundary_6 = BoundarySurfaces(Edges=circle_2)
panel_100 = Panel("boundary points")
preview_5 = CustomPreview(Geometry=boundary_6, Material=ColourSwatch(SwatchColor=RGB(0, 0, 0)))

circle_3 = CircleCNR(Center=pt_11, Normal=Vector(0, 0, 1), Radius=".1")
boundary_7 = BoundarySurfaces(Edges=circle_3)
preview_6 = CustomPreview(Geometry=boundary_7, Material=ColourSwatch(SwatchColor=RGB(0, 0, 0)))
