# Grasshopper definition Structural Rules Karamba.gh (Grasshopper 1.0.7)
# plug-ins: Anemone, Hops, Karamba3D, LunchBox, MetaHopper

roof_step = Slider(0.2, range=0..3)
# grid standard size and standard height
# You can change Height (floor to column top // beam bottom) and Roof Step, which is how much each roof panel translates in the vertical. See the output of the WFC roof.
height = Slider(2.5, range=0..3)

# ----
# Feel free to change the sliders, BUT!
# Grid size should be a multiple of 1 m or 1 m should be evenly divisible by the number. So 0.5, 0.25 or 2 m are fine. But other numbers will mess up the script because the modules are on a 1 m grid. Secondly the WFC algorithm also uses a similar grid, but is more flexible. However, at lower grid sizes computation time increases a lot.
grid_size = Slider(1, range=0..3)

# ---- group: Edge curve definition
# This curve or straight line defines the roof panel shape. It is currently a bezier curve, but feel free to change it and look at the Wave Function Collapse output roof
series = Series(Start=0, Step=0.1, Count=11)
graph = GraphMapper(series, x0=0, x1=1, y0=0, y1=1, container_name="Bezier", cpx=[0, 0.5786234736, 0.4061597884, 1], cpy=[0, 0, 1, 1])
dom = ConstructDomain(DomainStart=0, DomainEnd=roof_step)
dom_2 = ConstructDomain(DomainStart=0, DomainEnd=grid_size)
# Roof - Elements
panel = Panel(graph)
entwine = Entwine(Branch00=dom_2, Branch01=dom, FlattenInputs=True)
entwine_2 = Entwine(Branch00=series, Branch01=graph, FlattenInputs=True)
remap = RemapNumbers(Value=entwine_2, Source=Domain(0, 1), Target=entwine)  # -> Mapped, Clipped
bang = ExplodeTree(Data=remap.Mapped)  # -> Branch0, Branch1

# ----
# If True, then it will run the optimisation with multiple generations of structural optimisation. This will take forever!!!! Instead just play around with all the green items.
use_easter_island = BooleanToggle(False)

pt = ConstructPoint(XCoordinate=grid_size, YCoordinate=grid_size, ZCoordinate=0)
rec_2pt = Rectangle2Pt(Plane=PlaneXY(0, 0, 0), PointA=Point(0, 0, 0), PointB=pt, Radius=0)  # -> Rectangle, Length
panel_2 = Panel("Flat Roof panel")
area = Area(Geometry=rec_2pt.Rectangle)  # -> Area, Centroid

# ----
# Toggle hidden wires on and off using Metahopper plugin
toggle = BooleanToggle(True)
wiretoggle = WireDisplayToggle(ShowHiddenWires=toggle)

# ----
# Column element
# Only used in the beginning when assigning random columns.
pt_2 = ConstructPoint(XCoordinate=0, YCoordinate=0, ZCoordinate=0)
Z = UnitZ(Factor=height)
move = Move(Geometry=pt_2, Motion=Z)  # -> Geometry, Transform
ln = Line(StartPoint=pt_2, EndPoint=move.Geometry)

debrep = DeconstructBrep(Brep=rec_2pt.Rectangle)  # -> Faces, Edges, Vertices
# It is normal for some components to be red. Either they are purposefully creating a 'null' value such as for our empty roof tile.
# Or sometimes because of the many Stream Filters and Stream Gate, some streams have to be invalid depending on other settings and toggles in the script.
panel_3 = Panel("General notes")
# Input from
# Configuration Algorithm
# Lists of floorplans with details
panel_4 = Panel("""Floorplan options included

0              1        2              3               4""")
item = ListItem(List=debrep.Edges, Index=0, Wrap=True)  # -> Item, Item1, Item2, Item3
cycle_through_layout_options = Slider(0, range=0..4)
# Sliders to play with
# We realise some GHPython variable and definition names are not according to standard PEP 8.0 as they use camel case rather than underscores. These names were created prior to PEP being a requirement and GHPython does to support easy variable name changes like other coding environments such as VS Code or PyCharm. Therefore we have not updated all the names to use underscores simply because we are afraid of missing out renaming just one variable as that would break the code.
# We do apologize for any inconvenience CamelCasing might cause you compared to underscored_names.
example_slider = Slider(5, range=0..10)
Z_2 = UnitZ(Factor=roof_step)

# ---- group: Corner lifted
pt_3 = ConstructPoint(XCoordinate=0, YCoordinate=bang.Branch0, ZCoordinate=bang.Branch1)
intcrv = Interpolate(Vertices=pt_3, Degree=3, Periodic=False, KnotStyle=1)  # -> Curve, Length, Domain
end = EndPoints(Curve=intcrv.Curve)  # -> Start, End
rotate = Rotate(Geometry=intcrv.Curve, Angle=1.570796327, Plane=end.End)  # -> Geometry, Transform
line = Line(item.Item1)
line_2 = Line(item.Item)
netsurf = NetworkSurface(CurvesU=[intcrv.Curve, line], CurvesV=[rotate.Geometry, line_2], Continuity=2)

# ---- group: Corner Down
pt_4 = ConstructPoint(XCoordinate=0, YCoordinate=bang.Branch0, ZCoordinate=bang.Branch1)
intcrv_2 = Interpolate(Vertices=pt_4, Degree=3, Periodic=False, KnotStyle=1)  # -> Curve, Length, Domain
rotate_2 = Rotate(Geometry=intcrv_2.Curve, Angle=-1.570796327, Plane=PlaneXY(0, 0, 0))  # -> Geometry, Transform
line_3 = Line(item.Item1)
line_4 = Line(item.Item2)
move_2 = Move(Geometry=line_4, Motion=Z_2)  # -> Geometry, Transform
move_3 = Move(Geometry=line_3, Motion=Z_2)  # -> Geometry, Transform
netsurf_2 = NetworkSurface(CurvesU=[intcrv_2.Curve, move_3.Geometry], CurvesV=[rotate_2.Geometry, move_2.Geometry], Continuity=2)

# ---- group: Sloped straight
pt_5 = ConstructPoint(XCoordinate=0, YCoordinate=bang.Branch0, ZCoordinate=bang.Branch1)
X = UnitX(Factor=grid_size)
intcrv_3 = Interpolate(Vertices=pt_5, Degree=3, Periodic=False, KnotStyle=1)  # -> Curve, Length, Domain
move_4 = Move(Geometry=intcrv_3.Curve, Motion=X)  # -> Geometry, Transform
move_5 = Move(Geometry=item.Item2, Motion=Z_2)  # -> Geometry, Transform
netsurf_3 = NetworkSurface(CurvesU=[item.Item, move_5.Geometry], CurvesV=[move_4.Geometry, intcrv_3.Curve], Continuity=2)

# ---- group: Midpoint
division = Division(A=grid_size, B=2)
division_2 = Division(A=roof_step, B=2)
pt_6 = ConstructPoint(XCoordinate=division, YCoordinate=division, ZCoordinate=division_2)

# ---- group: Diagonal 2 corners
pt_7 = ConstructPoint(XCoordinate=0, YCoordinate=bang.Branch0, ZCoordinate=bang.Branch1)
intcrv_4 = Interpolate(Vertices=pt_7, Degree=3, Periodic=False, KnotStyle=1)  # -> Curve, Length, Domain
intcrv_5 = Interpolate(Vertices=pt_7, Degree=3, Periodic=False, KnotStyle=1)  # -> Curve, Length, Domain
rotate_3 = Rotate(Geometry=intcrv_4.Curve, Angle=-1.570796327, Plane=PlaneXY(0, 0, 0))  # -> Geometry, Transform
end_2 = EndPoints(Curve=intcrv_5.Curve)  # -> Start, End
rotate_4 = Rotate(Geometry=[intcrv_4.Curve, rotate_3.Geometry], Angle=1.570796327, Plane=pt_6)  # -> Geometry, Transform
Z_3 = UnitZ(Factor=expr("-x", roof_step))
rotate_5 = Rotate(Geometry=intcrv_5.Curve, Angle=1.570796327, Plane=end_2.End)  # -> Geometry, Transform
move_6 = Move(Geometry=rotate_4.Geometry, Motion=Z_3)  # -> Geometry, Transform
item_2 = ListItem(List=move_6.Geometry, Index=0, Wrap=True)  # -> Item, Item1
netsurf_4 = NetworkSurface(CurvesU=[intcrv_5.Curve, item_2.Item1], CurvesV=[rotate_5.Geometry, item_2.Item], Continuity=2)

# ----
# Introduction
# These colour codes apply to panels mainly. Group colours are only indicative to separate functions, unless if green or red, then they are for adjusting.
# Stuff to play with
# Advanced stuff to play with, perhaps read nearby warning if included
# (This may take a long time to execute...)
# output panels for observing values and other stuff for understanding process and results
panel_5 = Panel("Explanations")

entwine_3 = Entwine(
    Branch00=[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],
    Branch01=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,
    Branch02=[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],
    Branch03=[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],
    Branch04=[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],
    FlattenInputs=True)  # -> simplify(Result)
panel_6 = Panel("Other modules outlines")
branch = TreeBranch(Tree=entwine_3, Path=cycle_through_layout_options, MaintainPaths=True)
crv = Curve(branch)

# ----
# Door/opening points to exclude from support locations
entwine_4 = Entwine(
    Branch00=[Point(5, 1, 0), Point(5, 2, 0), Point(9, 4, 0), Point(9, 5, 0), Point(1, 7, 0), Point(1, 6, 0), Point(1, 5, 0), Point(1, 4, 0), Point(0, 4, 0), Point(0, 3, 0), Point(0, 2, 0), Point(0, 1, 0)],
    Branch01=[Point(3, 1, 0), Point(3, 2, 0), Point(3, 7, 0), Point(2, 7, 0), Point(1, 7, 0), Point(0, 7, 0)],
    Branch02=[Point(3, 1, 0), Point(3, 2, 0), Point(5, 4, 0), Point(6, 4, 0), Point(5, 9, 0), Point(4, 9, 0), Point(3, 10, 0), Point(3, 11, 0)],
    Branch03=[Point(6, 1, 0), Point(6, 2, 0), Point(1, 3, 0), Point(2, 3, 0), Point(4, 3, 0), Point(5, 3, 0), Point(6, 7, 0), Point(9, 7, 0), Point(8, 7, 0), Point(7, 7, 0), Point(11, 4, 0), Point(11, 3, 0)],
    Branch04=[Point(7, 1, 0), Point(7, 2, 0), Point(0, 1, 0), Point(0, 2, 0), Point(5, 8, 0), Point(7, 8, 0), Point(6, 8, 0)],
    FlattenInputs=True)  # -> simplify(Result)
branch_2 = TreeBranch(Tree=entwine_4, Path=cycle_through_layout_options, MaintainPaths=True)
pt_8 = Point(branch_2)

# ----
# You can change which floorplan is used in the current structural optimisation and roof WFC generation by adusting the slider.
edee = Entwine(
    Branch00=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,
    Branch01=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,
    Branch02=[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],
    Branch03=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,
    Branch04=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,
    FlattenInputs=True)  # -> simplify(Result)
# This here is the collection of floorplans imported from the Configuration algorithm script.
panel_7 = Panel("Package module outlines")
branch_3 = TreeBranch(Tree=edee, Path=cycle_through_layout_options, MaintainPaths=True)
crv_2 = Curve(branch_3)

# ---- group: flat
# These are the 5 unique types of roof panels required to generate any configuration of roof with our WFC algorithm. The last one is just a reference mid point for internal operations.
srf = Surface(rec_2pt.Rectangle)

# ---- group: Diagonal 2 corners
srf_2 = Surface(netsurf_4)

# ---- group: Corner lifted
srf_3 = Surface(netsurf)

# ---- group: Sloped Straight
srf_4 = Surface(netsurf_3)

# ---- group: Corner Down
srf_5 = Surface(netsurf_2)

# ---- group: Midpoint
pt_9 = Point(pt_6)

# ----
individual_floorplans = Data([crv_2, crv])
package_module_outline_only = Curve(crv_2)

# ----
# This loop is a proof of concept.
# 
# It shows that we can incoorporate human interaction into an Anenome loop, and therefore it would also be possible to require human interaction in the structural loop. For instance to choose between wall and column by clicking different buttons.
# 
# The first button resets the loop.
# The second button is required to allow the loop to progress past the 3rd loop.
# Human in the Loop
# Proof of Concept
line_5 = Line(Line((6.016586857, -0.5375996481, 0), (9.844560345, 1.047998887, 0)))
progress_past_3 = Button()
reset_loop = Button()
panel_8 = Panel(progress_past_3)
loop_start = LoopStart(N=Slider(10, range=0..10), T=reset_loop, D0=Slider(1, range=0..1), D1=line_5, D2="0", D3="0")  # -> port, Counter, Data, Data_2, Data_3, Data_4
loop_count = Panel(loop_start.Counter)
multiplication = Multiplication(A=loop_start.Data, B=Slider(5, range=0..10))
filter = StreamFilter(Gate=Slider(3, range=0..10), Stream3=loop_start.Data_2)
equals = Equality(FirstNumber=Slider(625, range=0..1000), SecondNumber=multiplication)  # -> Equality, Inequality
filter_2 = StreamFilter(Gate=equals.Equality, Stream0=loop_start.Data_2)
buffer = TimeBuffer(Data=multiplication, Ms=1500, UseThread=True)
filter_3 = StreamFilter(Gate=progress_past_3, Stream0=loop_start.Data_4, Stream1=filter)
filter_4 = StreamFilter(Gate=progress_past_3, Stream0=filter_2, Stream1=loop_start.Data_2)
line_6 = Line(filter_4)
running = Running(
    port=loop_start.port,
    Exit=False,
    Data=buffer,
    Data_2=line_6,
    Data_3=filter_3,
    Data_4=loop_start.Data_4,
    TimeOutVal=0,
    pausedState=False,
    state="Constant & Record")  # -> D0, D1, D2, D3
panel_9 = Panel(running.D0)
panel_10 = Panel(running.D2)

panel_11 = Panel(individual_floorplans)
runion = RegionUnion(Curves=individual_floorplans)

# ----
# Beams - Span Directions
# Primary span of rectangle, however, squares are still random and need to be replaced.
# Finding primary direction by longest span of rectangle.
# Vector direction for primary span
# If a box is square, sides are equal. Then we want to find the neighbouring box with the longest segment and continue that segment.
# Vector direction for secondary span
# The find the direction of that longest segment
# First find the rectangles that intersect (D = 0). Then from those pick the longest segment.
floorplan_outlines_multiple = Curve(individual_floorplans)
explode = Explode(Curve=floorplan_outlines_multiple, Recursive=True)  # -> Segments, Vertices
len = Length(Curve=explode.Segments)
split = SplitList(List=explode.Segments, Index=2)  # -> ListA, ListB
split_2 = SplitList(List=len, Index=2)  # -> ListA, ListB
dispatch = Dispatch(List=split_2.ListA, DispatchPattern=[True, False])  # -> ListA, ListB
larger = LargerThan(FirstNumber=dispatch.ListA, SecondNumber=dispatch.ListB)  # -> LargerThan, OrEqualTo
equals_2 = Equality(FirstNumber=dispatch.ListA, SecondNumber=dispatch.ListB)  # -> Equality, Inequality
dispatch_2 = Dispatch(List=floorplan_outlines_multiple, DispatchPattern=flatten(equals_2.Equality))  # -> ListA, ListB
crvprox = CurveProximity(CurveA=dispatch_2.ListA, CurveB=dispatch_2.ListB)  # -> PointA, PointB, Distance
equals_3 = Equality(FirstNumber=crvprox.Distance, SecondNumber="0")  # -> Equality, Inequality
bool = Boolean(invert(larger.LargerThan))
cull = CullPattern(List=dispatch_2.ListB, CullPattern=flatten(equals_3.Equality))
num = Number(bool)
lenseg = SegmentLengths(Curve=cull)  # -> ShortestLength, ShortestDomain, LongestLength, LongestDomain
sort = SortList(Keys=lenseg.LongestLength, ValuesA=cull)  # -> Keys, ValuesA
lng = ListLength(List=flatten(equals_2.Equality))
item_3 = ListItem(List=split.ListA, Index=num, Wrap=True)
item_4 = ListItem(List=sort.ValuesA, Index="-1", Wrap=True)
explode_2 = Explode(Curve=item_4, Recursive=True)  # -> Segments, Vertices
len_2 = Length(Curve=explode_2.Segments)
series_2 = Series(Start=0, Step=1, Count=lng)
sort_2 = SortList(Keys=len_2, ValuesA=explode_2.Segments)  # -> Keys, ValuesA
cull_2 = CullPattern(List=series_2, CullPattern=flatten(equals_2.Equality))
item_5 = ListItem(List=sort_2.ValuesA, Index="-1", Wrap=True)
panel_12 = Panel("Turning into vectors")
eval = EvaluateCurve(Curve=item_3, Parameter="0")  # -> Point, flatten(Tangent), Angle
eval_2 = EvaluateCurve(Curve=item_5, Parameter="0")  # -> Point, Tangent, Angle
replace = ReplaceItems(List=flatten(eval.Tangent), Item=eval_2.Tangent, Indices=cull_2, Wrap=False)
Z_4 = UnitZ(Factor=1)
vrot = Rotate(Vector=replace, Axis=Z_4, Angle=degrees("90"))
vec = Vector(replace)
vec_2 = Vector(vrot)

# ---- group: Press buttons on start, top then bottom
button = Button()
button_2 = Button()

# ----
# These are just two different, interesting shapes made by WFC. The second one shows a roof where the two parts are not directly connected.
geo = Geometry([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])
geo_2 = Geometry([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])

# ----
# The CSV has been internalised
panel_13 = Panel("C:\...\GitHub\")
concat = Concatenate(FragmentA=panel_13, FragmentB="CORE\structural\Material_datasheet.csv")
csv = ReadCSV(
    CSVString=["Material Name,Price (EUR/kg),Density (kg/m3),E Youngs Modules (MPa),E secondary (Mpa),Yield strength (Mpa),Yield secondary (Mpa),Shear mod primary G12 (Mpa),Shear mod secondary G13 (Mpa),Shear strength lowest t12 (Mpa),Poissons ratio,CO2 primary production (kg/kg),Water use primary production (l/kg),UV Radiation Resistance (1-4),Lifespan (years),Distance source to (Delft),Cross-section type", "Birch (betula alleghaniensis),0.855,690,15500,2200,55,3.8,1100,240,13,0.35,0.6,700,3,35,1000,Bulk", "Cork (high density),6.5,200,40,,1.6,,6,,,0.2,0.2,700,3,10,500,Bulk", "Cardboard,0.95,700,6000,,25,,1500,,,0.39,0.96,93,2,5,200,Bulk", "MDF,0.36,750,4000,,10.5,,500,,4.5,0.25,0.95,700,3,35,200,Bulk", "MDF Eco (75%),0.36,750,3000,,7.5,,400,,3.5,0.25,0.9,700,3,35,200,Bulk", "PET (30% glass fiber recycled content),1.4,1580,9500,,132,,3500,,,0.35,1.9,180,2,25,50,Bulk", "HDPE (general purpose) (plastic bags),0.74,958,1080,,28,,380,,,0.4,1.9,58,2,25,50,Bulk", "Reinforced concrete (8% low carbon steel),0.3,5350,45800,,9.4,,19400,,,0.22,0.4,25,4,60,100,Bulk", "Brick (Engineered sections),1.5,2500,80000,,8,,18000,,,0.22,0.25,7,4,60,100,Bulk", "Aluminium (commercial purity 1200 O),1.5,2720,70500,,40,,26000,,,0.33,8.9,1190,4,60,200,I-beam", "Steel (galvanised AISI 1010),0.68,7850,210000,,250,,82000,,,0.29,1.4,46,4,40,200,I-beam", "Mycelium composite,,,,,,,,,,,,,,,,"],
    Delimiter=",")  # -> Headers, Values
file = ReadFile(File=concat, PerLineParse=True)
flip = FlipMatrix(Data=csv.Values)

# ----
# Beware of the Easter Island toggle
list = ValueList({"Birch (betula alleghaniensis)": 0, "Cork (high density)": 1, "Cardboard": 2, "MDF": 3, "MDF Eco (75%)": 4, "PET (30% glass fiber recycled content)": 5, "HDPE (general purpose) (plastic bags)": 6, "Reinforced concrete (8% low carbon steel)": 7, "Brick (Engineered sections)": 8, "Aluminium (commercial purity 1200 O)": 9, "Steel (galvanised AISI 1010)": 10, "Mycelium composite": 11}, selected="Birch (betula alleghaniensis)")
panel_14 = Panel("Pick Material")

# ----
# Kit of Parts
# Dimensions
secondary_beam_height = Slider(0.21, range=0..1)
secondary_beam_width = Slider(0.1, range=0..1)
wall_thickness = Slider(0.1, range=0..0.5)
primary_beam_height = Slider(0.5, range=0..1)
primary_beam_width = Slider(0.1, range=0..1)
column_depth = Slider(0.15, range=0..1)
column_width = Slider(0.15, range=0..1)

# ----
# If a structure meets the deflection criterion the loop will exit, otherwise it will keep iterating adding more supports until all possible support locations are used.
# Some structures never meet the deflection criterion due to the material stiffness or other factors being unrealistic.
max_loop_count_for_structural_loop = Slider(30, range=0..30)
restart_structural_loop = Button()

deflection_absolute_cm = Slider(3, range=0..30)
joint_stiffness_factor = Slider(0.1, range=0.1..10)
deflection_relative_l_x = Slider(300, range=0..1000)
list_2 = ValueList({"Absolute Deflection limit (cm)": 0, "Relative Deflection limit L/x": 1}, selected="Relative Deflection limit L/x")

int = Integer(max_loop_count_for_structural_loop)

# ----
# Door/opening points to exclude from support locations
entwine_5 = Entwine(
    Branch00=[Point(5, 1, 0), Point(5, 2, 0), Point(9, 4, 0), Point(9, 5, 0), Point(1, 7, 0), Point(1, 6, 0), Point(1, 5, 0), Point(1, 4, 0), Point(0, 4, 0), Point(0, 3, 0), Point(0, 2, 0), Point(0, 1, 0)],
    Branch01=[Point(3, 1, 0), Point(3, 2, 0), Point(3, 7, 0), Point(2, 7, 0), Point(1, 7, 0), Point(0, 7, 0)],
    Branch02=[Point(3, 1, 0), Point(3, 2, 0), Point(5, 4, 0), Point(6, 4, 0), Point(5, 9, 0), Point(4, 9, 0), Point(3, 10, 0), Point(3, 11, 0)],
    Branch03=[Point(6, 1, 0), Point(6, 2, 0), Point(1, 3, 0), Point(2, 3, 0), Point(4, 3, 0), Point(5, 3, 0), Point(6, 7, 0), Point(9, 7, 0), Point(8, 7, 0), Point(7, 7, 0), Point(11, 4, 0), Point(11, 3, 0)],
    Branch04=[Point(7, 1, 0), Point(7, 2, 0), Point(0, 1, 0), Point(0, 2, 0), Point(5, 8, 0), Point(7, 8, 0), Point(6, 8, 0)],
    FlattenInputs=True)  # -> simplify(Result)
branch_4 = TreeBranch(Tree=entwine_5, Path=cycle_through_layout_options, MaintainPaths=True)
pt_10 = Point(branch_4)

entwine_6 = Entwine(
    Branch00=[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],
    Branch01=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,
    Branch02=[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],
    Branch03=[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],
    Branch04=[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],
    FlattenInputs=True)  # -> simplify(Result)
branch_5 = TreeBranch(Tree=entwine_6, Path=cycle_through_layout_options, MaintainPaths=True)
crv_3 = Curve(branch_5)

edee_2 = Entwine(
    Branch00=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,
    Branch01=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,
    Branch02=[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],
    Branch03=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,
    Branch04=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,
    FlattenInputs=True)  # -> simplify(Result)
panel_16 = Panel("Package module outlines")
branch_6 = TreeBranch(Tree=edee_2, Path=cycle_through_layout_options, MaintainPaths=True)
crv_4 = Curve(branch_6)

# ----
# This loop has not been developed fully yet. But it would simply iterate over the available floorplans and test the genomes on each. Then the fitness function would need to take the average fitness score or perhaps a sum squared fitness score.
# That way each genome is tested on multiple plan layouts, as they need to general and fit different floorplans to be suitable for a kit of parts.
# Loop 2 (Unpack 2.0)
# Iterate over list of floor plans
loop_start_2 = LoopStart(Repeat=0)  # -> port, Counter, Data
loop_end = LoopEnd(port=loop_start_2.port, Exit=False, Data=loop_start_2.Data, TimeOutVal=0, pausedState=False, state="Constant output")

mass_labels = Panel("""Secondary Beams
Walls
Columns
Primary Beams""")

# ----
# Roof - Package module sliding roof
# This group takes the package module and finds the central point, which is where the sliding roof willl be. The slider in green is for how many roof deep the sliding roof will be.
# 
# The results are used in the WFC to force it to create flat tiles in those locations.
# Secondly where the roof opens, the secondary beams will be removed, hence this information also connects to the beam creation part of the script.
package_module_plan_outline = Rectangle(package_module_outline_only)
debrep_2 = DeconstructBrep(Brep=package_module_plan_outline)  # -> Faces, Edges, Vertices
sort_3 = SortList(Keys=debrep_2.Edges, ValuesA=debrep_2.Edges)  # -> Keys, ValuesA
item_6 = ListItem(List=sort_3.ValuesA, Index=0, Wrap=True)  # -> Item1, Item
Z_5 = UnitZ(BaseHeight=height)
end_3 = EndPoints(Curve=item_6.Item1)  # -> Start, End
area_2 = Area(Geometry=package_module_plan_outline)  # -> Area, Centroid
vec2pt = Vector2Pt(PointA=end_3.Start, PointB=end_3.End, Unitize=False)  # -> unitize(Vector), Length
multiplication_2 = Multiplication(GridSize=grid_size, B="0.25")
multiplication_3 = Multiplication(A=vec2pt.Vector, B=multiplication_2)
addition = Addition(A=multiplication_3, B=Z_5)
move_7 = Move(Geometry=area_2.Centroid, Motion=addition)  # -> Geometry, Transform
number_of_rows_of_sliding_roof = Slider(2, range=0..10)
multiplication_4 = Multiplication(A=number_of_rows_of_sliding_roof, B="3")

subtraction = Subtraction(A=number_of_rows_of_sliding_roof, B=1)

# ----
# Roof - Wave Function Collapse
# This group is the Wave Function Collapse algorithm, used to generate or aggregate the roof based on a set of rules. It takes in the roof tiles. WFC is in a GHPython node. Then it outputs the roof geometry.
# 
# You can change the max allowable height difference of the roof. You can also click the toggle above the WFC to generate a new random roof layout for the current roof.
# Finding grid points that are inside the roof shape and therefore not empty tiles.
# Wave Function Collapse
# 
# Inside of GHPython node.
# Set to True if only flat roof desired.
# The distance here is if you want to make the roof bounding area larger. Not currently used, but was implemented for earlier designs.
# You should Preview this one if you want to see the funky roof shapes from WFC!
# This small Python script just relabels the 0's, 1's and 2's to a list of 0's and 1's of whether or not a point is inside the roof bounding area. Python is much better for rewriting a list this way.
# Grid of points where roof tiles can be located
# GH does not allow us to create an empty or null object, so the above is a work-around such that we have a null item in our repetoire of tiles for the areas outside the roof boundary.
roof_tile_types = Panel("""flat
sloped
corner_up
corner_down
diagonal
none_empty""")
Z_6 = UnitZ(BaseHeight=height)
corner_down = Data(srf_5)
crv_5 = Curve(runion)
roof_mid_points = Data(pt_9)
corner_up = Data(srf_3)
diagonal = Data(srf_2)
replace_2 = ReplaceItems(List="NONE", Indices="0", Wrap=False)
none_empty = Data(replace_2)
flat = Data(srf)
sloped = Data(srf_4)
grid_size_2 = Number(grid_size)
move_8 = Move(Geometry=crv_5, Motion=Z_6)  # -> Geometry, Transform
entwine_7 = Entwine(
    Branch00=flat,
    Branch01=sloped,
    Branch02=corner_up,
    Branch03=corner_down,
    Branch04=diagonal,
    Branch05=none_empty,
    FlattenInputs=True)  # -> flatten(Result)
offset = OffsetCurve(Curve=move_8.Geometry, Distance=Slider(0, range=0..3), Corners=3)
bbox = BoundingBox(Content=offset, Plane=PlaneXY(0, 0, 0))  # -> Box, Box_2
dim = Dimensions(Surface=bbox.Box)  # -> UDimension, VDimension
round = Round(Number=dim.VDimension)  # -> Nearest, Floor, Ceiling
round_2 = Round(Number=dim.UDimension)  # -> Nearest, Floor, Ceiling
area_3 = Area(Geometry=flatten(bbox.Box))  # -> Area, Centroid
division_3 = Division(A=round_2.Ceiling, B=grid_size_2)
division_4 = Division(A=round.Ceiling, B=grid_size_2)
round_3 = Round(Number=division_4)  # -> Nearest, Floor, Ceiling
series_3 = Series(Start=0, Step=grid_size_2, Count=round_3.Floor)
round_4 = Round(Number=division_3)  # -> Nearest, Floor, Ceiling
series_4 = Series(Start=0, Step=grid_size_2, Count=round_4.Floor)
pt_11 = ConstructPoint(XCoordinate=graft(series_3), YCoordinate=series_4, ZCoordinate=0)
rotate_6 = Rotate(Geometry=flatten(pt_11), Angle=-1.570796327, Plane=PlaneXY(0, 0, 0))  # -> Geometry, Transform
avr = Average(Input=flatten(rotate_6.Geometry))
vec2pt_2 = Vector2Pt(PointA=avr, PointB=area_3.Centroid, Unitize=False)  # -> Vector, Length
move_9 = Move(Geometry=rotate_6.Geometry, Motion=vec2pt_2.Vector)  # -> Geometry, Transform
max_height_of_roof = Slider(5, range=0..10)
incurve = PointInCurve(Point=move_9.Geometry, Curve=offset)  # -> Relationship, Point
python = GhPythonScript(x=incurve.Relationship)  # -> out, Empty; inputs x: list of Int32
# ---------- python: Python ----------
__author__ = "Sebastian Fischer Stripp"
__version__ = "2022.10.04"

'''
This script takes in a list of 1s, 0s and 2s (from a GH node). Then it turns
all 2s into 1s and finally it inverses the list. Making 1s into 0s and vice versa.
This gives a list with 1s in locations where the grid Cells are empty for the next
script to process
'''


import rhinoscriptsyntax as rs

# if it is 2, make it a 1
for i in range(len(x)):
    if x[i] == 2:
        x[i] = 1


# invert boolean list
for i in range(len(x)):
    if x[i] == 1:
        x[i] = 0
    elif x[i] == 0:
        x[i] = 1

# Export list
Empty = x
# ---------- end python ----------
new_roof_shape_toggle_once = BooleanToggle(True)
chill_out_wfc_flat_roof_only = BooleanToggle(False)
vec2pt_3 = Vector2Pt(PointA="0,0,0", PointB=move_9.Geometry, Unitize=False)  # -> Vector, Length

grid_of_points_for_wfc = Data(move_9.Geometry)
incurve_2 = PointInCurve(Point=grid_of_points_for_wfc, Curve=package_module_plan_outline)  # -> Relationship, Point
lng_2 = ListLength(List=grid_of_points_for_wfc)
equals_4 = Equality(FirstNumber=incurve_2.Relationship, SecondNumber="2")  # -> Equality, Inequality
series_5 = Series(Start=0, Step=1, Count=lng_2)
cull_3 = CullPattern(List=grid_of_points_for_wfc, CullPattern=equals_4.Equality)
cull_4 = CullPattern(List=series_5, CullPattern=equals_4.Equality)
dist = Distance(PointA=move_7.Geometry, PointB=cull_3)
sort_4 = SortList(Keys=dist, ValuesA=cull_4)  # -> Keys, ValuesA
equals_5 = Equality(FirstNumber=sort_4.Keys, SecondNumber="0")  # -> Equality, Inequality
cull_5 = CullPattern(List=sort_4.ValuesA, CullPattern=equals_5.Inequality)
split_3 = SplitList(List=cull_5, Index=multiplication_4)  # -> ListA, ListB
repeat = RepeatData(Data="0", Length=lng_2)
replace_3 = ReplaceItems(List=repeat, Item="1", Indices=split_3.ListA, Wrap=False)

# ----
# This Group is no longer in use. This was from earlier when we used Hops to connect to VS Code to call the Wave Function Collapse script. However, Hops has many bugs and the WFC script only uses functions availabe in GHPython, so therefore we now just use a GHPython node below.
# 
# This group has been left in to show how it was setup, such that you can activate the Flask server from within Grasshopper without needing to open VS Code.
# These buttons used to initiate the script, but will just give errors now. Not much fun. The fun is below.
panel_17 = Panel("http://127.0.0.1:5000/wavefunctioncollapse3")
path = FilePath()
filter_5 = StreamFilter(Gate=button, Stream0=panel_17, Stream1=path)
hops = Hops(
    _Path=filter_5,
    _Enabled=Button(ExpressionNormal="True", ExpressionPressed="False"),
    DimX=round_4.Floor,
    DimY=round_3.Floor,
    MaxHeight=max_height_of_roof,
    Empty=python.Empty,
    CacheResultsInMemory=False,
    CacheSolveResults=False,
    RemoteDefinitionLocation="http://127.0.0.1:5000/wavefunctioncollapse3",
    RemoteSolveVersion=(0, 1, 0),
    ShowInput_Enabled=True,
    ShowInput_Path=True,
    SynchronousSolve=False)  # -> NameIndices, Rotations, Heights
ghpython_script = GhPythonScript(hops_dir="C:\Users\...\GitHub\CORE\code\hops", run=button_2)  # -> out
# ---------- ghpython_script: Python ----------
__author__ = "Job de Vogel"
__version__ = "2022.10.04"

from subprocess import Popen
import os.path

name = "/app.bat"
dir = hops_dir + name

if run:
    p = Popen(["cmd", "/K", dir])
    print('Server is running in cmd...')
# ---------- end ghpython_script ----------

# ---- group: Half grid siz\e, to centre tiles
vec_3 = VectorXYZ(XComponent=expr("x/2", grid_size_2), YComponent=expr("x/2", grid_size_2), ZComponent=0)  # -> Vector, Length

# ----
python_2 = GhPythonScript(
    again_new_form=new_roof_shape_toggle_once,
    grid_x=round_4.Floor,
    grid_y=round_3.Floor,
    max_height=max_height_of_roof,
    empty_tiles=python.Empty,
    roof_sliding_tiles=replace_3)  # -> out, tile_number, tile_rotation, tile_height; inputs grid_x: Int32, grid_y: Int32, max_height: Int32, empty_tiles: list of Int32, roof_sliding_tiles: list of Int32
# ---------- python_2: Python ----------
__author__ = "Sebastian Fischer Stripp"
__version__ = "2022.10.06"



'''
Wave Function Collapse implementation based on JavaScript for P5 tutorial
from The Coding Train https://www.youtube.com/watch?v=rI_y2GAlQFM

Wave Function Collapse for 2.5D created by Sebastian Fischer Stripp

This simple implementation of Wave Function Collapse works in 2.5D, as it
is a 2D surface, which has height and therefore almost becomes a 3D aggregation.
This implementation works for any set of tiles and is not limited to roof tiles.
If more complex tiles are desired the neighbour rules in definition analyse(self, tiles)
would need to be updated to suit your unique tiles as well as the list of 
tile names called listOfTileNames.
The list of locations describes a grid in x and y dimensions. This is the input
and output list. The pre and post processing makes sure that the grid is consistent
and can scale to any dimensions. It is robust and general.

GHPython Keyword arguments:
again new form -- this toggle prompts the function to run again, making a new tile layout.
grid_x -- integer, size of total grid in x direction
grid_y -- integer, size of total grid in y direction
max_height -- integer, maximmum height that tiles can translate to in aggregation
empty_tiles --list of 1s and 0s indicating whether a cell location is inside or outside boundary.
roof_sliding_tiles -- list of 1s and 0s indicating if cell should be flat tile only.

Outputs:
tile_number -- list of integers, the index number of which tile is in that position.
tile_rotation -- list of integers, the rotation in degrees for that tile in that location
tile_height -- list of integers, the vertical translation of the tile
'''



import rhinoscriptsyntax as rs
import random
import copy


def runWFC(dx, dy, mh, empty,roof_sliding):
    '''
    This run function will generate and return a tile layout within the given
    boundary and with specified flat tiles in location marked by roof_sliding.
    
    The function works based on two classes.
    Tile class, describing a tile and its
    properties such as the edge conditions which determine what it can and cannot
    connect to as well as its rotation from the standard direction as each tile
    has a total of 4 versions, one for each square rotation. There is one Tile
    class instance for each unique tile, multiplied by rotations (4) and maximum
    height allowed.
    Cell class describes each location in the grid. Each grid location is a Cell.
    Those cells can contain only one Tile when they are collapse, but until then
    they contain a list of potential tiles that can fit into that Cell given the 
    neighbouring tiles and the connection rules. At the beginning only the empty
    Cells are collapsed, because they contain empty Tiles, which are essentially
    blank or air. In this roof example that means grid Cells outside the roof boundary
    are just empty Cells.
    
    Explanation:
    The Tiles and their connection rules are initialised. The grid Cell locations
    are also initialised and empty Cells outside the boundary are collapse to
    empty. Then the Cell with the lowest entropy (lowest number of potential Tiles)
    is collapsed. Usually all have an equal number of potentialities, therefore a
    random Cell is collapse if no single lowest Cell is present. The neighbour
    conditions are propogated throughout the system. Then the new entropies are ranked
    and the Cell with the lowest entropy is collapsed. This is usually a Cell
    near to the previosuly collapsed Cell.
    This will continue until all Cells are collapse and the roof is finished.
    
    
    Keyword arguments:
    dx -- integer, dimension in x direction
    dy -- integer, dimension in y direction
    mh -- integer, max height translation for any tile
    empty -- list of 1s and 0s of empty cell locations
    roof_sliding_tiles -- list of 1s and 0s indicating if cell should be flat tile only.
    
    Outputs:
    tile_number -- list of integers, the index number of which tile is in that position.
    tile_rotation -- list of integers, the rotation in degrees for that tile in that location
    tile_height -- list of integers, the vertical translation of the tile
    '''



    DIM_x = int(dx) 
    DIM_y = int(dy) 
    max_height = int(mh)

    grid = [] # this will contain all the Cell objects that need to be collapsed
    tiles = [] # list of possible Tile objects populated by makeTiles
    listOfTileNames = ['flat', 'sloped', 'corner_up', 'corner_down', 'diagonal', 'NONE_tile'] # used in transfer to GH later to get indices

    class Tile: # each unique tile is an instance of this class
        def __init__(self, name, edges, rotation, height=0):
            '''
            This is the class for each Tile.
            They all have a name, referring to which shape/type of tile, flat, sloped etc
            The edges are their edge condition, important for the rules in analyse(self, tiles)
            to check which tiles can be matched.
            The rotation and height describe how the tile is translate from its
            original master position and orientation to create this Tile.
            The functions inside this class are called when initiating a tile
            in order to populate it with all its possible rotations and heights
            as well as analysing the possible edge matches.
            '''
            
            self.name = name #tile name
            self.edges = edges #edge conditions as list, top, right, btm, left. F Flat, R right-up, L left-up
            self.rotation = rotation #degrees that it is rotated, 0, 90, 180, 270
            self.height = height # height of the tile. A unique tile for each height
            
            # These lists are populated by the analyse(self, tiles) function.
            # The lists contain the indices of which tiles can be
            # connected to that tile in each direction.
            self.up = []
            self.right = []
            self.down = []
            self.left = []
        
        # This function, analyse, is called once to iterate over all tiles in the
        # session and populate their edge matches. These are basically the rules
        # for aggregation. It then add that information the the self.up, right etc
        # attribute of that tile.
        # If you look at the rules you can see that 0F (flat at height 0) can connect
        # to another 0F if their height is the same. But 1F and 0F can connect if
        # their heights are one apart, in the right order.
        # Also note, due to assymetry, L left must connect to a R right tile
        # dR and dL are DownRight and DownLeft as the Diagonal tile spans 2 heights.
        def analyse(self, tiles): # new with correct L R opposite pairing because of asymmetry
            # first loop throught each unique tile
            for i, tile in enumerate(tiles):
                direction_attr = ['up', 'right', 'down', 'left']
                # then loop through each of the 4 directions (up, right, down, left) for that tile
                for dir in range(4):
                    #up direction first at index 0 and the tile above index 2. The modulo operater solves the issue of 'list out of range' when dir gets greater than 4.
                    if (
                    (self.edges[(0+dir)%4] == '0F'     and tile.edges[(2+dir)%4] == '0F' and self.height == tile.height) or
                    (self.edges[(0+dir)%4] == '1F'     and tile.edges[(2+dir)%4] == '1F' and self.height == tile.height) or
                    (self.edges[(0+dir)%4] == '0F'     and tile.edges[(2+dir)%4] == '1F' and self.height - tile.height == 1) or
                    (self.edges[(0+dir)%4] == '1F'     and tile.edges[(2+dir)%4] == '0F' and self.height - tile.height == -1) or
                    (self.edges[(0+dir)%4] == 'R'   and tile.edges[(2+dir)%4] == 'L' and self.height == tile.height) or
                    (self.edges[(0+dir)%4] == 'L'   and tile.edges[(2+dir)%4] == 'R' and self.height == tile.height) or
                    (self.edges[(0+dir)%4] == 'dL'   and tile.edges[(2+dir)%4] == 'R' and self.height - tile.height == 1) or
                    (self.edges[(0+dir)%4] == 'dR'   and tile.edges[(2+dir)%4] == 'L' and self.height - tile.height == 1) or
                    (self.edges[(0+dir)%4] == 'L'   and tile.edges[(2+dir)%4] == 'dR' and self.height - tile.height == -1) or
                    (self.edges[(0+dir)%4] == 'R'   and tile.edges[(2+dir)%4] == 'dL' and self.height - tile.height == -1)
                    ):
                        # if a tile matches an edge condition, add it to that directions list. For instance the self.left list.
                        edgeMatches = getattr(self, direction_attr[dir])
                        edgeMatches.append(i)
                        setattr(self, direction_attr[dir], edgeMatches)

            #Also add empty tile to neighbour possibilities of each tile, because any tile can next to an empty tile
            self.up.append(len(tiles)-1) #picking the last tile in the tile index list, which is the empty none_tile
            self.down.append(len(tiles)-1)
            self.right.append(len(tiles)-1)
            self.left.append(len(tiles)-1)

        # rotate a tile by a specified angle and return the tile
        def rotate(self, angle): #clockwise rotation
            if angle % 90 != 0:
                print('ERROR: rotation angle for tile is not divisible by 90!!!!!! ERROR!!')
            for i in range(int(angle / 90)):
                newEdges = [self.edges[-1]]  + self.edges[:-1]
                self.edges = newEdges
            self.rotation = angle
            return self
        
        # translate the height of a tile and return the tile
        def heightMove(self, MoveAmount): #moves tile
            self.height = MoveAmount
            return self




    class Cell:
        '''
        This class describes a grid location. Each grid location or Cell can contain
        one Tile in the end.
        In the beginning it contains a list of tile_options, all the possible
        tiles that could be in that location. This list becomes smaller and smaller
        as the neighbouring tiles are collapsed into a single Tile.
        '''
        
        def __init__(self, collapsed, tile_options):
            # the self.collapsed is a boolean of whether or not it contains
            # just a single tile. If so it will be excluded from the updating process
            # self.tile_options is the ever decreasing list of possible tiles
            # for that Cell.
            self.collapsed = collapsed
            self.tile_options = tile_options    #at first it contains all the tiles


    # That's the Tile class and Cell class created. The Tile class contains the rules.


    def makeTiles(max_height):
        # This function creates the tiles. It takes in the maximum height,
        # because all tiles are replicated to each unique height location.
        
        # This appends to the list of tiles, with rotation 0 and height 0.
        # Then they are deepcopied with rotation
        # Further down they are copied with heights
        # It's Tile, (name), (edges conditions), (rotation), height=0 as standard.
        tiles.append(Tile('flat', ['0F','0F','0F','0F'], 0))

        tiles.append(Tile('sloped', ['1F', 'R', 'F', 'L'], 0))
        tiles.append(copy.deepcopy(tiles[1]).rotate(90))
        tiles.append(copy.deepcopy(tiles[1]).rotate(180))
        tiles.append(copy.deepcopy(tiles[1]).rotate(270))

        tiles.append(Tile('corner_up', ['R', '0F', '0F', 'L'], 0))
        tiles.append(copy.deepcopy(tiles[5]).rotate(90))
        tiles.append(copy.deepcopy(tiles[5]).rotate(180))
        tiles.append(copy.deepcopy(tiles[5]).rotate(270))

        tiles.append(Tile('corner_down', ['1F', '1F', 'R', 'L'], 0))
        tiles.append(copy.deepcopy(tiles[9]).rotate(90))
        tiles.append(copy.deepcopy(tiles[9]).rotate(180))
        tiles.append(copy.deepcopy(tiles[9]).rotate(270))

        tiles.append(Tile('diagonal', ['R', 'dR', 'dL', 'L'], 0))
        tiles.append(copy.deepcopy(tiles[13]).rotate(90))
        tiles.append(copy.deepcopy(tiles[13]).rotate(180))
        tiles.append(copy.deepcopy(tiles[13]).rotate(270))

        #deepcopy and create multiple with different heights
        # loop through each tile in list
        for each in range(len(tiles)):
            # loop as many times as the integer max_height, so one for each height
            for i in range(max_height):
                tiles.append(copy.deepcopy(tiles[each]).heightMove(i+1)) # i+1 because height 0 already exists as the original

        #create empty tile. The is the blank tile which will be placed outside the roof boundary.
        # height doesn't matter for the empty tile, so it is not copied with different heights.
        tiles.append(Tile('NONE_tile', ['N','N','N','N'],0))

        # sanalyse and populate neighbour possibilities for each Tile
        # loop throgh each tile. The analyse(tiles) will append to the tiles
        # own self.up, self.right etc attribute lists of possible neighbour Tiles.
        for each_tile in tiles:
            each_tile.analyse(tiles)

        # populate boundary tile for none_tile. This adds all possible tile matches to the none_tile.
        # In analyse(tiles) we added the none_tile as a possible neighbour, but the reserve must
        # also be true. So none_tile need all possible tiles as its possible neighbour.
        indices_for_real_tiles = []
        # add all indices for real tiles. So all but the last one.
        for i in range(len(tiles)-1):
            indices_for_real_tiles.append(i)
        # append those indices as possible neighbours for the empty tile none_tile (-1) in the list of tiles.
        tiles[-1].up = indices_for_real_tiles
        tiles[-1].down = indices_for_real_tiles
        tiles[-1].left = indices_for_real_tiles
        tiles[-1].right = indices_for_real_tiles


    # This checkValid function is called every time a Cell update. It then checks 
    # two neighbouring Cells and checks that their possible matches align.
    # This is because when a nearby Cell collapses, the changes ripple out
    # and the possible neighbours become more limited.
    def checkValid(potential_tiles_near, valid_for_cell, direction, opp_dir):
        # potential_tiles_near is the list of tile_options for the neighbouring tile
        # valid_for_cell is the list of tile_options for the current Cell
        # direction is the (up, right, down, left) direction currently being assessed
        # opp_dir is the opposite direction as up for Cell is the down edge for the neighbour
        possible_cell = valid_for_cell
        new_possible_for_direction = []
        # This cycles through all the possible tiles that could be placed next to it
        # and check the valid neighbours should that be the selected tile for that neighbour
        for option in potential_tiles_near:
            new_possible_for_direction.append(getattr(tiles[option], opp_dir))
        new_possible_for_direction = [item for sublist in new_possible_for_direction for item in sublist] #flattening list of lists
        # Then return the intersection of the two sets of possible tiles.
        # So the Cell has an updated list of tiles match in the self.up direction for instance
        return set(possible_cell).intersection(set(new_possible_for_direction))
        # This checkValid function is called repeatedly to propogate the updates to all Cells


    # This definition cycles through all the grid Cells in order and updates their 
    # tile_options and neighbour possibilities.
    # The updateCount keeps track of the number of updates and is used later to force
    # a Cell to randomly collapse if it doesn't collapse naturally.
    # The cellUpdate cycles through x and y of the grid, hence loop in loop.
    # It then looks in each direction, up, right etc and updates the possible neighbours
    # for the direction.
    def cellUpdate():
        updateCount = 0 # increments each time a Cell tile_options is updated
        for y in range(DIM_y): # loop through y direction
            for x in range(DIM_x): # loop through x direction
                index = x + y * DIM_x # the current index in the grid is kept track of
                if grid[index].collapsed == False: # if a Cell is collapsed (it has a single Tile) it is skipped
                    #Look up, and update tile_options to suit upwards neighbour
                    if y > 0: # only check if it has a neighbour upwards. The top edge does not have any neighbours upwards.
                        up = grid[x + (y - 1) * DIM_x] # object of the up neighbour Cell
                        possibleTiles = checkValid(up.tile_options, grid[index].tile_options, 'up', 'down') # update list of possible tiles
                        if possibleTiles != grid[index].tile_options: # if the lists are different, then update and add 1 to the count
                            updateCount += 1
                            grid[index].tile_options = possibleTiles # update the tile_options for that Cell
                    #Look right, and update tile_options to suit rightwards neighbour
                    if x < DIM_x - 1:
                        right = grid[x + 1 + y * DIM_x]
                        possibleTiles = checkValid(right.tile_options, grid[index].tile_options, 'right', 'left')
                        if possibleTiles != grid[index].tile_options:
                            updateCount += 1
                            grid[index].tile_options = possibleTiles
                    #Look down, and update tile_options to suit downwards neighbour
                    if y < DIM_y - 1:
                        down = grid[x + (y + 1) * DIM_x]
                        possibleTiles = checkValid(down.tile_options, grid[index].tile_options, 'down', 'up')
                        if possibleTiles != grid[index].tile_options:
                            updateCount += 1
                            grid[index].tile_options = possibleTiles
                    #Look left, and update tile_options to suit leftwards neighbour
                    if x > 0:
                        left = grid[x - 1 + y * DIM_x]
                        possibleTiles = checkValid(left.tile_options, grid[index].tile_options, 'left', 'right')
                        if possibleTiles != grid[index].tile_options:
                            updateCount += 1
                            grid[index].tile_options = possibleTiles
        return updateCount # to track total number of updates for one iteration through the grid


    # this is a print statement for checking the code in this GHPython window only.
    # lists of names, rotations etc will also be printed inside this window only.
    print('\nStart code')

    # call the makeTiles to populate list of tiles for each allowed height
    makeTiles(max_height)

    # populate grid Cells with all possible tiles. At first they can contain any tile.
    # However, if it is an empty or roof_sliding grid location, then that Cell will only contain that.
    # loop through whole grid which is x * y long
    for i in range(DIM_x*DIM_y):
        if empty[i] == 1: # creates a collapsed empty cell. This is for the area outside the roof, which is filled with Empty none_tiles.
            grid.append(Cell(
                True, # self.collapsed is True, because there is only one tile option
                [len(tiles)-1] #this is a list of possible tiles, but we only want the last one, which is the empty tile
                ))
        elif roof_sliding[i] == 1: # For package module where roof has to be flat and Height = 0
            grid.append(Cell(
                True, # self.collapsed is True, because there is only one tile option
                [0] # This assigns tile 0 from the tile list which is the flat tile at height = 0
                ))
        elif empty[i] == 0 and roof_sliding[i] == 0: #any other normal roof location
            grid.append(Cell(
                False, # self.collapsed is False, because it has multiple possible tiles that could be here
                [item for item in range(len(tiles)-1)] #This populates the list of possible tiles for this grid location. We use Tiles -1 on the end to not count the empty tile at the last index. That way they cannot collapse to an empty none_Tile
                )) #set of indices for possible tiles
        else:
            assert False, "This shouldn't happen. A grid location did not meet the above categories"


    while_loop_count = 0 # This is just for curiosity to track how many times the grid is iterated over.
    # The while loop will keep iterating over the grid. Updating the neighbour possiblities.
    # if there are not updates, updateCount ==0, then it will collapse the Cell with the lowest entropy,
    # entropy meaning the fewest possible options. (This is why it's called Wave Function Collapse, it comes from quantum mechanics)
    while len([item for item in grid if item.collapsed == False]) > 0: # while any Cell is not collapsed, loop
        updateCount = cellUpdate() # iterate over grid and update neighbours.

        if updateCount == 0: # if nothing has updated, then collapse lowest entropy Cell
            gridCopy = grid # make copy
            gridCopy = sorted(gridCopy, key= lambda e:len(e.tile_options)) # sort by lowest number of tile options
            gridCopy = [item for item in gridCopy if item.collapsed == False] # remove collapsed ones
            # list of lowest entropy Cells, this adds all the Cell with the same number of tile options as the lowest to the list.
            lowest_entropy = [item for item in gridCopy if len(gridCopy[0].tile_options) == len(item.tile_options)]
            # now select one randomly to randomly collapse
            if len(lowest_entropy) > 0:
                picked = random.choice(lowest_entropy) # pick a random Cell from the list of lowest_entropy
                picked.collapsed = True
                picked.tile_options = [random.choice(tuple(picked.tile_options))] # choose a random tile from the tile_options which will become this Cell's tile
        
        while_loop_count += 1


    # print statements are just for inside this GHPython window to see what's happening
    print('This is how many times the whole grid was updated: ', while_loop_count)

    print('Tile names')
    print([tiles[item.tile_options[0]].name for item in grid])

    print('rotations')
    print([tiles[item.tile_options[0]].rotation for item in grid])

    print('name indices')
    print([listOfTileNames.index(tiles[item.tile_options[0]].name) for item in grid])

    print('heights')
    print([tiles[item.tile_options[0]].height for item in grid])


    #returns name indices, rotation, heights
    return (
    [listOfTileNames.index(tiles[item.tile_options[0]].name) for item in grid],
    [tiles[item.tile_options[0]].rotation for item in grid],
    [tiles[item.tile_options[0]].height for item in grid]
    )


# call the WFC function, which returns name indices, rotations and heights
tile_number, tile_rotation, tile_height = runWFC(grid_x, grid_y, max_height, empty_tiles ,roof_sliding_tiles)
# ---------- end python_2 ----------
python_3 = GhPythonScript(flat_only=chill_out_wfc_flat_roof_only, tile_number=python_2.tile_number, tile_height=python_2.tile_height)  # -> out, tile_no_out, tile_height_out; inputs flat_only: Boolean, tile_number: list of Int32, tile_height: list of Int32
# ---------- python_3: Python ----------
__author__ = "Sebastian Fischer Stripp"
__version__ = "2022.10.05"

'''
This script takes in a list of numbers. If the number is 5, it remains a 5. 
Otherwise it becomes a 0.
5 represents an empty tile. 0 is a flat tile.
This replaces all tiles with simple flat tiles, giving a flat roof.

All heights are also changed to 0 when flat tiles only are requested.
'''

import rhinoscriptsyntax as rs

# new list of flat and empty tiles only
N_flat = []

# if tile is empty (5) keep it as that. Otherwise make it 0
for i in tile_number:
    if i == 5:
        N_flat.append(i)
    else:
        N_flat.append(0)

# If the toggle is true or false, change the output accordingly, and heights to 0
if flat_only == True:
    tile_no_out = N_flat
    tile_height_out = [0 for i in tile_height]

elif flat_only == False:
    tile_no_out = tile_number
    tile_height_out = tile_height
# ---------- end python_3 ----------
Z_7 = UnitZ(Factor=python_3.tile_height_out)
multiplication_5 = Multiplication(A=Z_7, RoofStepHeight=roof_step)
subtraction_2 = Subtraction(A=vec2pt_3.Vector, B=vec_3.Vector)
item_7 = ListItem(List=entwine_7, Index=python_3.tile_no_out, Wrap=True)
move_10 = Move(Geometry=roof_mid_points, Motion=subtraction_2)  # -> Geometry, Transform
move_11 = Move(Geometry=item_7, Motion=subtraction_2)  # -> Geometry, Transform
rotate_7 = Rotate(Geometry=flatten(move_11.Geometry), Angle=expr("-x", degrees(python_2.tile_rotation)), Plane=move_10.Geometry)  # -> Geometry, Transform
move_12 = Move(Geometry=rotate_7.Geometry, Motion=multiplication_5)  # -> Geometry, Transform
brep = Brep(move_12.Geometry)

# ----
# Column Initialization - random
# This takes in valid connection points. Removed door locations etc. Then it assigns the 3 random initial columns.
# Assign first random columns
grid_size_3 = Number(grid_size)
base_height = Number(height)
points_to_exclude_door_openings = Point(pt_8)
Z_8 = UnitZ(Factor=base_height)
move_13 = Move(Geometry=points_to_exclude_door_openings, Motion=Z_8)  # -> Geometry, Transform
int_2 = Integer("0")

# ----
# Beams - Geometry
# Removing 2nd beams overlapping primary as well as 2nd beams overlappign 2nd beams.
primary_span_vectors = Vector(vec)
brief_outline_curves = Curve(individual_floorplans)
explode_3 = Explode(Curve=brief_outline_curves, Recursive=True)  # -> Segments, Vertices
xy = XYPlane(Origin=Point(0, 0, 0))
xy_2 = XYPlane(Origin=Point(0, 0, 0))
panel_18 = Panel("Beam proportions")
eval_3 = EvaluateCurve(Curve=explode_3.Segments, Parameter="0")  # -> Point, Tangent, Angle
angle = Angle(VectorA=graft(primary_span_vectors), VectorB=eval_3.Tangent)  # -> Angle, Reflex
deg = Degrees(Radians=angle.Angle)
mod = Modulus(A=deg, B="180")
equals_6 = Equality(FirstNumber=mod, SecondNumber="0")  # -> Equality, Inequality
grid_size_4 = Number(grid_size)
dispatch_3 = Dispatch(List=explode_3.Segments, DispatchPattern=equals_6.Equality)  # -> ListA, ListB
midpt = CurveMiddle(Curve=dispatch_3.ListB)
end_4 = EndPoints(Curve=dispatch_3.ListB)  # -> Start, End
item_8 = ListItem(List=midpt, Index=0, Wrap=True)  # -> Item, Item1
end_5 = EndPoints(Curve=dispatch_3.ListA)  # -> Start, End
vec2pt_4 = Vector2Pt(PointA=end_4.Start, PointB=end_4.End, Unitize=False)  # -> Vector, Length
Z_9 = UnitZ(Factor=1)
vec2pt_5 = Vector2Pt(PointA=item_8.Item, PointB=item_8.Item1, Unitize=False)  # -> Vector, Length
vec2pt_6 = Vector2Pt(PointA=end_5.Start, PointB=end_5.End, Unitize=False)  # -> Vector, Length
division_5 = Division(A=vec2pt_6.Length, B=grid_size_4)
item_9 = ListItem(List=division_5, Index=0, Wrap=True)
vrot_2 = Rotate(Vector=vec2pt_4.Vector, Axis=Z_9, Angle=degrees("90"))
vec_4 = Vector(unitize(vec2pt_5.Vector))
series_6 = Series(Start=0, Step=grid_size_4, Count=expr("x+1", item_9))
Z_10 = UnitZ(Factor=1)
Z_11 = UnitZ(Factor=1)
pl = ConstructPlane(Origin=end_4.Start, XAxis=vrot_2, YAxis=Z_10)
xy_3 = XYPlane(Origin=Point(0, 0, 0))
vrot_3 = Rotate(Vector=vec2pt_6.Vector, Axis=Z_11, Angle=degrees("90"))
multiplication_6 = Multiplication(A=vec_4, B=series_6)
Z_12 = UnitZ(Factor=1)
pl_2 = ConstructPlane(Origin=end_5.Start, XAxis=vrot_3, YAxis=Z_12)
xy_4 = XYPlane(Origin=Point(0, 0, 0))
height_2 = Number(height)

# ----
# Beams - Elements for Karamba
# Karamba only needs lines to indicate beam location. However, these lines also need to intersect exactly. Therefore, beam lines for the structural Karamba model are extracted at this point.
base_height_2 = Number(height)
Z_13 = UnitZ(Factor=base_height_2)

# ----
# Material Selection
# G12 is the larger shear compared to G13, 31 and G32.
# https://manual.karamba3d.com/3-in-depth-component-reference/3.4-material/3.4.1-material-properties
item_10 = ListItem(List=flip, Index=0, Wrap=True)  # -> flatten(Item)
panel_19 = Panel(item_10)
panel_20 = Panel(csv.Headers)

# ----
# Easter Island
# Generality
# This GHPython function for Easter Island can take any number of boundary conditions of any range with any valid increments. It will create genomes of the appropriate length with N number genes for N number of boundary conditions.
# It can even use non continious variables such as the Materials List because each material is represented by an index.
# Genome
# Creation
# Fitness
# Calculation
# What percentage of ranked population is allowed to breed
panel_21 = Panel(item_10)
panel_22 = Panel("Step size:")
panel_23 = Panel("Range:")
total_number_of_generations = Slider(0, range=0..20)
secondary_beam_height_2 = Slider(8, range=0..100)
secondary_beam_width_2 = Slider(8, range=0..100)
primary_beam_height_2 = Slider(8, range=0..100)
primary_beam_width_2 = Slider(8, range=0..100)
winnerpercentage = Slider(0.2, range=0..1)
column_w_d = Slider(8, range=0..100)
wall_thickness_2 = Slider(8, range=0..100)
populationsize = Slider(40, range=0..200)
mutationrate = Slider(0.1, range=0..1)
panel_24 = Panel("Material indeces")
entwine_8 = Entwine(
    Branch00="1 to 100",
    Branch01="1 to 100",
    Branch02="1 to 100",
    Branch03="1 to 100",
    Branch04="1 to 100",
    Branch05="1 to 50",
    Branch06="0 to 8",
    FlattenInputs=True)
merge = Merge(
    Data1=column_w_d,
    Data2=primary_beam_height_2,
    Data3=primary_beam_width_2,
    Data4=secondary_beam_height_2,
    Data5=secondary_beam_width_2,
    Data6=wall_thickness_2,
    Data7="1")
loop_start_3 = LoopStart(N=total_number_of_generations, T=Button())  # -> port, Loop_Count, Data, PopulationPool, Fitness_scores, Data_2
python_4 = GhPythonScript(
    Loop_Count=loop_start_3.Loop_Count,
    fitness_scores=loop_start_3.Fitness_scores,
    DesignBounds=entwine_8,
    BoundsIncrements=merge,
    PopulationSize=populationsize,
    WinnerPercentage=winnerpercentage,
    MutationRate=mutationrate,
    PopulationPool=loop_start_3.PopulationPool)  # -> out, PopulationPool; inputs Loop_Count: Int32, fitness_scores: list, DesignBounds: tree, BoundsIncrements: list of Int32, PopulationSize: Int32, PopulationPool: tree
# ---------- python_4: Python ----------
__author__ = "Sebastian Fischer Stripp"
__version__ = "2022.10.15"


'''
Easter Island takes in boundary conditions and creates a list of list of genomes.
The fitness is calculated by another Python module, but the results feed back
into this module to rank each genome. Then the next generation is created
based on the fittest individuals from the previous generation.

Keyword arguments for GHPython:
Loop_Count -- current loop count from Anenome. This is necessary when
    initialisinng the first generation of genomes.
fitness_score -- this is used when loop count < 0 to rank the previous generation.
DesignBound -- a list of list of the boundary conditions for the genomes.
BoundsIncrements -- a handy value to specify unique increments for each
    boundary condition. The standard Galapagos implementation does
    not support this kind of functionality!
PopulationSize -- the number of genomes for each generation
WinnerPercentage -- The percent of the total generation used to generate the
    next generation. If set to 20%, only the top 20% fittest become part of
    the breeding pool for the new genomes.
MutationRate -- the rate or chance of random mutations in a genome.
PopulationPool -- the previous generations population which is used together
    with the fitness to generate the next generation.

Output:
PopulationPool -- A list of lists (data tree in GH) of the genomes of the
    current generation.
'''



import rhinoscriptsyntax as rs
import Grasshopper as gh
import random

#These list comprehensions turn a Grasshopper data tree into lists of lists
DesignBoundsPy = [list(b) for b in DesignBounds.Branches]
PopulationPool = [list(b) for b in PopulationPool.Branches]


def listToTree(nestedList):
    """Convert a nested python iterable to a datatree.
    This is called in the end when outputting the list of lists of genomes
    to a GH data tree
    
    Keyword arguments:
    nestedList -- a list of lists to be converted
    
    Output:
    A data tree in a format suitable for GH
    """
    
    dt = gh.DataTree[object]()
    for i,l in enumerate(nestedList):
        dt.AddRange(l,gh.Kernel.Data.GH_Path(i))
        
    return dt




BoundsRange = [] # a list of list of the ranges of the boundary conditions

# splitting the strings that describe the bounds ranges into lists of lists
# containing the start and end number
for i in range(len(DesignBoundsPy)):
    DesignBoundsPy[i] = (DesignBoundsPy[i][0].split())
    DesignBoundsPy[i].pop(1)
    # make the strings into integers
    for each in range(len(DesignBoundsPy[i])):
        DesignBoundsPy[i][each] = int(DesignBoundsPy[i][each])
    BoundsRange.append(DesignBoundsPy[i][1] - DesignBoundsPy[i][0])



AllowedGenes = [] # a list of lists of eac allowed gene, created from the 
# increment sizes. This is used to initialise and create random mutations
#to ensure they are one of the valid bound increments.

#These two loops create a list of possible genes for each boundary condition.
for i in range(len(DesignBoundsPy)):
    steps = []
    BoundsRange[i] / BoundsIncrements[i]
    counter = 0
    while DesignBoundsPy[i][0] + counter * BoundsIncrements[i] < DesignBoundsPy[i][1]:
        steps.append(DesignBoundsPy[i][0] + counter * BoundsIncrements[i])
        counter += 1
    # adding the top bound as some will not hit the top bound perfectly with their range division
    steps.append(DesignBoundsPy[i][1])
    AllowedGenes.append(steps)


# create first random PopulationPool
if Loop_Count == 0: 
    #Generation 0
    PopulationPool = []
    # for each genome in populationsize, give it a collection of genes from the allowable genes pool.
    for i in range(PopulationSize):
        genome = []
        
        for each in range(len(DesignBoundsPy)):
            genome.append(random.choice(AllowedGenes[each]))
        PopulationPool.append(genome)
    
    # convert list of lists to GH data tree structure as final step
    PopulationPool = listToTree(PopulationPool)


# for subsequent loops we take the fitness score and associate it to the genomes. Then we sort them by their fitness.
if Loop_Count > 0:
    for i in range(len(PopulationPool)):
        PopulationPool[i].append(fitness_scores[i])
    
    # sort by their fitess, which is now their last index item for each genome
    PopulationSorted = sorted(PopulationPool, key=lambda x: x[-1])
    
    
    
    
    
    
    # Parents breeding
    # the integer number of winners selected for breeding new generation
    WinnerNumber = int(round(PopulationSize * WinnerPercentage))
    
    Parents = []
    
    # for each winner add them to the parents list
    for i in range(WinnerNumber):
        parent = PopulationSorted[i]
        del parent[-1] # remoove the fitness value
        Parents.append(parent)
    
    
    
    def breeding():
        '''
        This function returns a genome, generated from the parents pool.
        This current implementation allows for the two parents to be the same
        parent, in which case there will be a forced mutation on half the genes.
        In all cases there is a possibility for general random mutation,
        which will affect one gene and randomly pick another allowed value from
        the pool of allowed genes.
        
        returns a list, which a genome
        '''
        
        # randomly choose two parents
        parent1 = random.choice(Parents)
        parent2 = random.choice(Parents)
        child = []
        
        # for each gene, flip a coin and use that to select a gene from parent 1 or 2
        for i in range(len(parent1)): # for each gene pick from one parent
            coin = random.randint(0,1)
            if coin == 0:
                child.append(parent1[i])
            elif coin == 1:
                child.append(parent2[i])
            else:
                print('faulty coin')
        
        # incest mutation: If the two parents are the same, force a mutation
        if parent1 == parent2:
            for i in range(int(len(parent1)/2)): # mutate half the genes
                geneNo = random.randint(0,len(parent1)-1)
                child[geneNo] = random.choice(AllowedGenes[geneNo])
                # This loop is set up such that maybe half the genes will mutate
                # but in other cases the same gene might be mutated
                # multiple times, leading to fewer overall mutations
                # this is an intentional part of the incest mutation.
        
        # random mutation based on the MutationRate input variable
        if random.randint(0,100) / 100 <= MutationRate: #pick a random number, if that is lower than MutationRate than it mutates.
            geneNo = random.randint(0,len(child)-1)
            child[geneNo] = random.choice(AllowedGenes[geneNo])
            
        return child
    
    
    # This here is the next generation, the children. The loop below populates 
    # the list calling the breeding() definition above. 
    children= []
    for i in range(PopulationSize):
        children.append( breeding() )
    
    # Then the new genome pool is the children.
    PopulationPool = children # new generation
    
    # Finally calling the helper function to convert to GH tree structure.
    PopulationPool = listToTree(PopulationPool)
# ---------- end python_4 ----------
genomes = Panel(python_4.PopulationPool)
tstat = TreeStatistics(Tree=python_4.PopulationPool)  # -> Paths, Length, Count
panel_25 = Panel("""Loop 1
Easter Island""")
line_7 = Line()

# ----
# Loop 3
# Open each genome for loop 4
# This loop unpacks each genome for the structural algorithm.
division_6 = Division(A=python_4.PopulationPool, B=100)
tstat_2 = TreeStatistics(Tree=division_6)  # -> Paths, Length, Count
subtraction_3 = Subtraction(A=tstat_2.Count, B=1)
loop_start_4 = LoopStart(N=subtraction_3, T=Button(), Genome=division_6)  # -> port, Counter, Data, Genome, Data_2, Data_3, Data_4, Data_5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
line_8 = Line()
line_9 = Line()
branch_7 = TreeBranch(Tree=loop_start_4.Genome, Path=loop_start_4.Counter, MaintainPaths=True)
filter_6 = StreamFilter(Gate=use_easter_island, Stream0=line_9, Stream1="0")
item_11 = ListItem(List=branch_7, Index=0, Wrap=True)  # -> Item, Item1, Item2, Item3, Item4, Item5, Item6
multiplication_7 = Multiplication(A=item_11.Item6, B=100)

filter_7 = StreamFilter(Gate=use_easter_island, Stream0=list, Stream1=multiplication_7)
material_no_choice = GetInteger(
    filter_7,
    {"Birch (betula alleghaniensis)", "Cork (high density)", "Cardboard", "MDF", "MDF Eco (75%)", "PET (30% glass fiber recycled content)", "HDPE (general purpose) (plastic bags)", "Mycelium composite", "Aluminium (commercial purity 1200 O)", "Steel (galvanised AISI 1010)", "Reinforced concrete (8% low carbon steel)", "Brick (Engineered sections)"}, selected=[],
    AtLeast=1,
    AtMost=1,
    Maximum=2147483647,
    Minimum=-2147483648,
    TreeAccess=False)
branch_8 = TreeBranch(Tree=flip, Path=material_no_choice, MaintainPaths=True)
item_12 = ListItem(List=branch_8, Index=0, Wrap=True)
panel_26 = Panel(item_12)
bang_2 = ExplodeTree(Data=graft(branch_8))  # -> Branch0, Branch1, Branch2, Branch3, Branch4, Branch5, Branch6, Branch7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
context_print = ContextPrint(MaterialSelected=item_12)
matprops = MaterialPropertiesKaramba3D(
    FamilyOfMaterial="Custom",
    Name=bang_2.Branch0,
    YoungsModulusKNCm2Dir1=expr("0.1*x", bang_2.Branch3),
    YoungsModulusKNCm2Dir2=expr("0.1*x", bang_2.Branch4),
    InPlaneShearModulus_kN_cm2=expr("0.1*x", bang_2.Branch7),
    InPlaneLateralContractionCoefficient=1,
    TransverseShearModulusKNCm2Dir1=expr("0.1*x", bang_2.Branch8),
    TransverseShearModulusKNCm2Dir2=expr("0.1*x", bang_2.Branch8),
    SpecificWeight_kN_m3=expr("9.81*x/1000", bang_2.Branch2),
    CoefficientOfThermalExpansion1CDir1=1.2e-05,
    CoefficientOfThermalExpansion1CDir2=1.2e-05,
    TensileStrengthKNCm2Dir1=expr("0.1*x", bang_2.Branch5),
    TensileStrengthKNCm2Dir2=expr("0.1*x", bang_2.Branch6),
    CompressiveStrengthKNCm2Dir1=expr("-0.1*x", bang_2.Branch5),
    CompressiveStrengthKNCm2Dir2=expr("-0.1*x", bang_2.Branch6),
    ShearStrengthKNCm2Dir12=expr("0.1*x", bang_2.Branch9),
    TsaiWuIntCoeff=0,
    StrengthHypothesis="MISES",
    mode="Orthotropic")
matprops_2 = MaterialPropertiesKaramba3D(
    FamilyOfMaterial="Custom",
    Name=bang_2.Branch0,
    YoungsModulus_kN_cm2=expr("0.1*x", bang_2.Branch3),
    InPlaneShearModulus_kN_cm2=expr("0.1*x", bang_2.Branch7),
    TransverseShearModulus_kN_cm2=expr("0.1*x", bang_2.Branch7),
    SpecificWeight_kN_m3=expr("9.81*x/1000", bang_2.Branch2),
    CoefficientOfThermalExpansion_1_C=1.2e-05,
    TensileStrength_kN_cm2=expr("0.1*x", bang_2.Branch5),
    CompressiveStrength_kN_cm2=expr("-0.1*x", bang_2.Branch5),
    StrengthHypothesis="MISES",
    mode="Isotrop")

item_13 = ListItem(List=branch_8, Index="4", Wrap=True)
equals_7 = Equality(FirstNumber=item_13, SecondNumber=item_13)  # -> Equality, Inequality
or = GateOr(A=equals_7.Equality, B="False")
filter_8 = StreamFilter(Gate=or, Stream0=matprops_2, Stream1=matprops)

filter_9 = StreamFilter(Gate=use_easter_island, Stream0=column_width, Stream1=item_11.Item)
filter_10 = StreamFilter(Gate=use_easter_island, Stream0=column_depth, Stream1=item_11.Item)
filter_11 = StreamFilter(Gate=use_easter_island, Stream0=primary_beam_height, Stream1=item_11.Item1)
filter_12 = StreamFilter(Gate=use_easter_island, Stream0=primary_beam_width, Stream1=item_11.Item2)
filter_13 = StreamFilter(Gate=use_easter_island, Stream0=secondary_beam_height, Stream1=item_11.Item3)
filter_14 = StreamFilter(Gate=use_easter_island, Stream0=secondary_beam_width, Stream1=item_11.Item4)
filter_15 = StreamFilter(Gate=use_easter_island, Stream0=wall_thickness, Stream1=item_11.Item5)

pt_12 = ConstructPoint(XCoordinate=filter_12, YCoordinate=filter_11, ZCoordinate=0)
pt_13 = ConstructPoint(XCoordinate=filter_14, YCoordinate=filter_13, ZCoordinate=0)
rec_2pt_2 = Rectangle2Pt(Plane=xy, PointA=expr("-x/2", pt_13), PointB=expr("x/2", pt_13), Radius=0)  # -> Rectangle, Length
rec_2pt_3 = Rectangle2Pt(Plane=xy_2, PointA=expr("-x/2", pt_12), PointB=expr("x/2", pt_12), Radius=0)  # -> Rectangle, Length
orient = Orient(Geometry=rec_2pt_2.Rectangle, Source=xy_3, Target=pl)  # -> Geometry, Transform
area_4 = Area(Geometry=orient.Geometry)  # -> Area, Centroid
line_10 = LineSDL(Start=area_4.Centroid, Direction=vec2pt_4.Vector, Length=vec2pt_4.Length)
orient_2 = Orient(Geometry=rec_2pt_3.Rectangle, Source=xy_4, Target=pl_2)  # -> Geometry, Transform
item_14 = ListItem(List=line_10, Index=0, Wrap=True)
area_5 = Area(Geometry=orient_2.Geometry)  # -> Area, Centroid
item_15 = ListItem(List=orient.Geometry, Index=0, Wrap=True)
line_11 = LineSDL(Start=area_5.Centroid, Direction=vec2pt_6.Vector, Length=vec2pt_6.Length)
move_14 = Move(Geometry=item_14, Motion=multiplication_6)  # -> Geometry, Transform
move_15 = Move(Geometry=item_15, Motion=multiplication_6)  # -> Geometry, Transform
ext = ExtendCurve(Curve=move_14.Geometry, Type=0, Start="-0.1", End="-0.1")  # -> simplify(Curve)
extr = Extrude(Base=orient_2.Geometry, Direction=line_11)
colom = CollisionOneMany(Collider=ext, Obstacles=flatten(line_11))  # -> Collision, Index
_2nd_beam_h = Number(filter_13)
_1st_beam_h = Number(filter_11)
cap = CapHoles(Brep=extr)
cull_6 = CullPattern(List=move_14.Geometry, CullPattern=invert(colom.Collision))
cull_7 = CullPattern(List=move_15.Geometry, CullPattern=invert(colom.Collision))
subtraction_4 = Subtraction(A=_1st_beam_h, B=_2nd_beam_h)
rdlines = RemoveDuplicateLinesKaramba3D(Line=flatten(cull_6), LimitDistance=0.005)  # -> OutLine, Info, Indexes
division_7 = Division(A=subtraction_4, B=2)
cull_i = CullIndex(List=flatten(cull_7), Indices=rdlines.Indexes, Wrap=True)
entwine_9 = Entwine(Branch00=cull_i, Branch01=rdlines.OutLine, FlattenInputs=True)
_1st_beam_h_2 = Number(filter_11)
division_8 = Division(A=_1st_beam_h_2, B=2)
Z_14 = UnitZ(Factor=division_7)
subtraction_5 = Subtraction(A=height_2, B=division_8)
Z_15 = UnitZ(Factor=subtraction_5)
move_16 = Move(Geometry=cap, Motion=Z_15)  # -> Geometry, Transform
primary_beams = Geometry(move_16.Geometry)

midpt_2 = CurveMiddle(Curve=rdlines.OutLine)
dist_2 = Distance(PointA=move_7.Geometry, PointB=midpt_2)
# This distance and sorting here removes the beams where the package module roof opens.
sort_5 = SortList(Keys=dist_2, ValuesA=entwine_9)  # -> Keys, ValuesA
split_4 = SplitList(List=sort_5.ValuesA, Index=subtraction)  # -> ListA, ListB

bang_3 = ExplodeTree(Data=split_4.ListB)  # -> Branch0, Branch1
move_17 = Move(Geometry=bang_3.Branch1, Motion=Z_13)  # -> Geometry, Transform
move_18 = Move(Geometry=line_11, Motion=Z_13)  # -> Geometry, Transform
secondary_beams = Line(move_17.Geometry)
primary_beams_2 = Line(move_18.Geometry)

move_19 = Move(Geometry=split_4.ListB, Motion=Z_14)  # -> Geometry, Transform
bang_4 = ExplodeTree(Data=move_19.Geometry)  # -> Branch0, Branch1
extr_2 = Extrude(Base=bang_4.Branch0, Direction=bang_4.Branch1)
cap_2 = CapHoles(Brep=extr_2)
move_20 = Move(Geometry=cap_2, Motion=Z_15)  # -> Geometry, Transform
secondary_beams_2 = Geometry(move_20.Geometry)
merge_2 = Merge(Data1=primary_beams, Data2=secondary_beams_2)

secondary_beams_3 = Line(secondary_beams)
primary_beams_3 = Line(primary_beams_2)

primary_beams_4 = Line(primary_beams_2)
divlength = DivideLength(Curve=primary_beams_4, Length=grid_size_3)  # -> Points, Tangents, Parameters
rdpoints = RemoveDuplicatePointsKaramba3D(Point=flatten(divlength.Points), LimitDistance=0.005)  # -> OutPoint, Info, Indexes
cp = ClosestPoint(Point=move_13.Geometry, Cloud=rdpoints.OutPoint)  # -> ClosestPoint, CPIndex, Distance
int_3 = Integer(cp.Distance)
equals_8 = Equality(FirstNumber=int_3, SecondNumber=int_2)  # -> Equality, Inequality
cull_8 = CullPattern(List=cp.CPIndex, CullPattern=equals_8.Equality)
replace_4 = ReplaceItems(List=rdpoints.OutPoint, Indices=cull_8, Wrap=False)
clean = CleanTree(RemoveNulls=True, RemoveInvalid=True, RemoveEmpty=False, Tree=replace_4)

pt_14 = Point(flatten(rdpoints.OutPoint))

pt_15 = Point(flatten(pt_14))
lng_3 = ListLength(List=pt_15)
subtraction_6 = Subtraction(A=lng_3, B=Slider(3, range=0..10))
reduce = RandomReduce(List=pt_15, Reduction=subtraction_6, Seed=Slider(25, range=-1..60))
vec2pt_7 = Vector2Pt(PointA=move.Geometry, PointB=reduce, Unitize=False)  # -> Vector, Length
move_21 = Move(Geometry=ln, Motion=vec2pt_7.Vector)  # -> Geometry, Transform

allowable_support_positions = Data(pt_15)
initial_random_columns = Data(move_21.Geometry)

# ----
# This is the master structural script. Inside the cluster below are all the structural magic in the form of countless Karamba nodes.
# 
# Feel free to play with the sliders in green to modify the structure.
# 
# Click the button to rerun the structure after changing parameters.
# Structural Script
loop_start_5 = LoopStart(
    N=int,
    T=restart_structural_loop,
    Random_Line_columns=initial_random_columns,
    Allowed_Support_connections=allowable_support_positions,
    Primary_Beams=primary_beams_3,
    Secondary_Beams=secondary_beams_3)  # -> port, Counter, Line_columns, AllowedSupportConnections, PrimaryBeams, SecondaryBeams, WallBrep
lng_4 = ListLength(List=loop_start_5.AllowedSupportConnections)
pt_16 = Point(loop_start_5.AllowedSupportConnections)
loop_count_2 = Panel(loop_start_5.Counter)
support_locations_remaining = Panel(lng_4)
panel_27 = Panel("""Loop 4
Karamba - Structural""")

# ----
# Have a look inside, it's terrifying...
# 
# terrifyingly well organised :D
cluster = Cluster(
    L_3=loop_start_5.AllowedSupportConnections,
    primary_beams_3=primary_beams_3,
    deflection_limit_choice=list_2,
    deflection_allowed_absolute_cm=deflection_absolute_cm,
    deflection_allowed_length_x=deflection_relative_l_x,
    joint_stiffness_factor=joint_stiffness_factor,
    column_width=filter_9,
    column_depth=filter_10,
    T=loop_start_5.WallBrep,
    primary_beam_height=filter_11,
    primary_beam_width=filter_12,
    sec_beam_height=filter_13,
    C=loop_start_5.PrimaryBeams,
    sec_beam_width=filter_14,
    wall_thickness=filter_15,
    grid_size=grid_size,
    base_height=height,
    roof_step_height=roof_step,
    plan_outline=runion,
    A=loop_start_5.Counter,
    plan_each_outline=individual_floorplans,
    L=loop_start_5.Line_columns,
    _0=loop_start_5.Line_columns,
    material_karamba=filter_8,
    allowed_support_connections_3=loop_start_5.AllowedSupportConnections,
    previous_wall_locations=loop_start_5.WallBrep,
    allowed_support_connections=loop_start_5.AllowedSupportConnections,
    line=loop_start_5.PrimaryBeams,
    primary_beams=loop_start_5.PrimaryBeams,
    line_2=loop_start_5.SecondaryBeams)  # -> allowable_support_connections, exit_condition_trigger, column_width_3, column_depth_3, primary_beam_height_3, primary_beam_width_3, sec_beam_height_3, sec_beam_width_3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
deflections_for_each_load_case = Panel(cluster.disp)

# ----
# Here you can choose a fitness objective and also adjust hyperparameters for certain FOs.
# You would need to enable the Easter Island to actually see this do stuff. But this will take a long time to process and iterate.
# If penalty exponent = 1, then price increase is proportional. If larger it becomes exponential.
fo_09_standard_maximum_dimension_cm = Slider(35, range=0..100)
fo_09_price_increase_exponent = Slider(1.4, range=1..3)
list_3 = ValueList({"FO-01: ( number of columns * bias )  * ( mass * deflection )": 0, "FO-02: mass * deflection": 1, "FO-03: Distance from source * mass": 2, "FO-04: Minimal cost": 3, "FO-05: Lifetime (UV Radiation based) / Cost in long term": 4, "FO-06: Minimal CO2": 5, "FO-07: Minimal water": 6, "FO-08: Min cost and min co2 with CO2 offset cost": 7, "FO-09: Min cost, increasing cost with larger cross sections": 8}, selected="FO-02: mass * deflection")
fo_03_bias_for_source_distance = Slider(1, range=0..3)
fo_08_co2_penalty_ton = Slider(30, range=30..150)
fo_01_bias_for_columns = Slider(1, range=0..3)
merge_3 = Merge(
    Data1=cluster.column_width_3,
    Data2=cluster.column_depth_3,
    Data3=cluster.primary_beam_height_3,
    Data4=cluster.primary_beam_width_3,
    Data5=cluster.sec_beam_height_3,
    Data6=cluster.sec_beam_width_3,
    Data7=cluster.wall_thickness_3)

loop_end_2 = LoopEnd(
    port=loop_start_5.port,
    Exit=cluster.exit_condition_trigger,
    Line_columns=cluster.new_line_columns,
    AllowedSupportConnections=cluster.allowable_support_connections,
    PrimaryBeams=cluster.L_2,
    SecondaryBeams=loop_start_5.SecondaryBeams,
    WallBrep=cluster.new_walls,
    TimeOutVal=0,
    pausedState=False,
    state="Constant output")  # -> Line_columns, Allowed_Support_connections, Primary_Beams, Secondary_Beams, Wall_Brep

equals_9 = Equality(FirstNumber=int, SecondNumber=loop_start_5.Counter)  # -> Equality, Inequality
or_2 = GateOr(A=cluster.exit_condition_trigger, B=equals_9.Equality)
filter_16 = StreamFilter(Gate=or_2, Stream0=line_8, Stream1=or_2)
running_2 = Running(
    port=loop_start_4.port,
    Exit=False,
    DisableLoop=filter_6,
    Genome=loop_start_4.Genome,
    LineColumns=loop_end_2.Line_columns,
    WallBreps=loop_end_2.Wall_Brep,
    Deflection=cluster.disp,
    MassKg=cluster.mass,
    WaitForLoopBeforeToFinish=filter_16,
    MaterialName=bang_2.Branch0,
    CostEuroKg=bang_2.Branch1,
    DistanceFromMaterialSource=bang_2.Branch15,
    MatLifetime=bang_2.Branch14,
    C02KgKg=bang_2.Branch11,
    WaterLKg=bang_2.Branch12,
    TimeOutVal=0,
    pausedState=False,
    state="Constant & Record")  # -> Disable_loop, Genome, Line_Columns, Wall_breps, Deflection, Mass_kg, D6, Material_name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

trim = TrimTree(Tree=simplify(running_2.Mass_kg), Depth=1)
multiplication_8 = Multiplication(A=running_2.Deflection, B=running_2.Deflection)
tstat_3 = TreeStatistics(Tree=running_2.Line_Columns)  # -> Paths, Length, Count
ma = MassAddition(Input=multiplication_8)  # -> flatten(Result), PartialResults
ma_2 = MassAddition(Input=trim)  # -> flatten(Result), PartialResults
python_5 = GhPythonScript(
    standard_max_dim=fo_09_standard_maximum_dimension_cm,
    price_increase_exponent=fo_09_price_increase_exponent,
    current_cross_section_dims=merge_3)  # -> out, bias_penalty; inputs current_cross_section_dims: list
# ---------- python_5: Python ----------
__author__ = "sebas"
__version__ = "2022.11.05"

import rhinoscriptsyntax as rs


#This implementation is naive as the whole structure is penalised, even if it is only one member that is above standard dims.
#find max cross section in current design
max_cross_section = max(current_cross_section_dims)

if max_cross_section <= standard_max_dim:
    bias_penalty = 1

# The exponent makes it increasingly more expensive to be much larger than the standard size
elif max_cross_section > standard_max_dim:
    bias_penalty = ( max_cross_section / standard_max_dim ) ** price_increase_exponent

else:
    print('Must be an error')



print(max_cross_section)
print(bias_penalty)
# ---------- end python_5 ----------
division_9 = Division(A=fo_08_co2_penalty_ton, B="1000")
python_6 = GhPythonScript(
    Pool_size=tstat.Count,
    mass=ma_2.Result,
    deflection=ma.Result,
    no_columns=tstat_3.Length,
    cost=flatten(running_2.Cost_Euro_kg),
    source_distance=flatten(running_2.Distance_from_material_source),
    lifetime=flatten(running_2.Mat_Lifetime),
    CO2=flatten(running_2.C02_kg_kg),
    water=flatten(running_2.Water_l_kg),
    fitness_choice_number=list_3,
    bias_columns=fo_01_bias_for_columns,
    bias_source_distance_penalty=fo_03_bias_for_source_distance,
    bias_co2_price_penalty=division_9,
    bias_max_dim_penalty=python_5.bias_penalty)  # -> out, fitness_scores; inputs mass: list, deflection: list, no_columns: list of Int32, cost: list, source_distance: list, lifetime: list, CO2: list, water: list, fitness_choice_number: Int32
# ---------- python_6: Python ----------
__author__ = "sebas"
__version__ = "2022.10.20"

import rhinoscriptsyntax as rs


#Fitness functions
##
#fitness_functions = [(mass * deflection), (mass / cost)]
#
#
#print(fitness_functions[0])
#print(fitness_functions[1])



fitness_scores = []


#a = fitness_functions[fitness_choice_number]

for i in range(Pool_size):
    
    fitness_functions = [
        ( no_columns[i] * bias_columns * mass[i] * deflection[i] ),
        ( mass[i] * deflection[i]),
        ( source_distance[i] * bias_source_distance_penalty * mass[i] * deflection[i]),
        ( cost[i] * mass[i] * deflection[i]),
        ( 1 / lifetime[i] * cost[i] * deflection[i]),
        ( mass[i] * CO2[i] * deflection[i]),
        ( mass[i] * water[i] * deflection[i]),
        ( ( cost[i] + CO2[i] * bias_co2_price_penalty ) * mass[i] * deflection[i] ),
        ( cost[i] * bias_max_dim_penalty * mass[i] * deflection[i] )
        ]
    
    fitness_scores.append(fitness_functions[fitness_choice_number])
# ---------- end python_6 ----------
equals_10 = Equality(FirstNumber=subtraction_3, SecondNumber=loop_start_4.Counter)  # -> Equality, Inequality
python_7 = GhPythonScript(x=python_6.fitness_scores)  # -> out, nan_removed; inputs x: list
# ---------- python_7: Python ----------
__author__ = "sebas"
__version__ = "2022.10.25"

import rhinoscriptsyntax as rs


for i in range(len(x)):
    if x[i] != x[i]: # checking for nan objects
        print("nan match found")
        x[i] = max(x)

nan_removed = x
# ---------- end python_7 ----------
lng_5 = ListLength(List=python_7.nan_removed)
equals_11 = Equality(FirstNumber=tstat.Count, SecondNumber=lng_5)  # -> Equality, Inequality
and = GateAnd(A=equals_10.Equality, B=equals_11.Equality)
filter_17 = StreamFilter(Gate=and, Stream0=line_7, Stream1=equals_10.Equality)
buffer_2 = TimeBuffer(Data=filter_17, Ms="50", UseThread=True)
loop_end_3 = LoopEnd(
    port=loop_start_3.port,
    Exit=False,
    Data=loop_start_3.Data,
    PopulationPool=python_4.PopulationPool,
    Fitness_scores=python_7.nan_removed,
    WaitForLoopBeforeToFinish=buffer_2,
    TimeOutVal=0,
    pausedState=False,
    state="Constant & Record")  # -> D0, D1, fitness_scores, D3

# ----
# You can preview the geomtry here. Karamba with stress colour or just a solid coloured mesh.
mesh = Mesh(cluster.mesh_output)
mcol = MeshColours(Mesh=mesh, Colours=RGB(128, 101, 101))

masses = Data(cluster.mass)

# ----
# Post processing. The structural geometry can be output to the next script which adds the aesthetic beams and columns.
# These outputs are for using a Hops cluster. This is in case you want to reference this structural Karamba from another GH file.
# This was our original strategy, but Hops does not seem to like Anenome loops.
# This is no longer really in use, but we have left it in as an example of how it could be packaged.
context_print_2 = ContextPrint(AllowedConectionRoofPoints=loop_end_2.Allowed_Support_connections)
context_print_3 = ContextPrint(SecondaryBeams=loop_end_2.Secondary_Beams)
context_print_4 = ContextPrint(PrimaryBeams=loop_end_2.Primary_Beams)
context_print_5 = ContextPrint(Line_columns=loop_end_2.Line_columns)
context_print_6 = ContextPrint(ModelMesh=cluster.meshes)
context_print_7 = ContextPrint(Deflections=cluster.disp)
co2_kg_kg = Data(bang_2.Branch11)
context_print_8 = ContextPrint(Text=brep)
context_print_9 = ContextPrint(MassKg=cluster.mass)
water_l_kg = Data(bang_2.Branch12)
multiplication_9 = Multiplication(A=cluster.mass, B=co2_kg_kg)
multiplication_10 = Multiplication(A=cluster.mass, B=water_l_kg)
context_print_10 = ContextPrint(Water=multiplication_10)
# Output to next algorithm
context_print_11 = ContextPrint(Text=multiplication_9)

ma_3 = MassAddition(Input=masses)  # -> flatten(Result), PartialResults
lng_6 = ListLength(List=masses)  # -> flatten(Length)
counts = Panel(lng_6)
total_masses = Panel(ma_3.Result)

# ==== cluster Cluster
primary_beam_height = ClusterInput()
primary_beam_width = ClusterInput()
sec_beam_height = ClusterInput()
wall_thickness = ClusterInput()
sec_beam_width = ClusterInput()
column_depth = ClusterInput()
column_width = ClusterInput()
material_karamba = ClusterInput()
plan_each_outline = ClusterInput()
roof_step_height = ClusterInput()
plan_outline = ClusterInput()
base_height = ClusterInput()
grid_size = ClusterInput()
deflection_allowed_absolute_cm = ClusterInput()
deflection_allowed_length_x = ClusterInput()
joint_stiffness_factor = ClusterInput()

primary_beam_height_2 = GetNumber(primary_beam_height, AtLeast=1, AtMost=1, Maximum=1.797693135e+308, Minimum=-1.797693135e+308, TreeAccess=False)
primary_beam_width_2 = GetNumber(primary_beam_width, AtLeast=1, AtMost=1, Maximum=1.797693135e+308, Minimum=-1.797693135e+308, TreeAccess=False)
sec_beam_height_2 = GetNumber(sec_beam_height, AtLeast=1, AtMost=1, Maximum=1.797693135e+308, Minimum=-1.797693135e+308, TreeAccess=False)
wall_thickness_2 = GetNumber(wall_thickness, AtLeast=1, AtMost=1, Maximum=1.797693135e+308, Minimum=-1.797693135e+308, TreeAccess=False)
sec_beam_width_2 = GetNumber(sec_beam_width, AtLeast=1, AtMost=1, Maximum=1.797693135e+308, Minimum=-1.797693135e+308, TreeAccess=False)
column_depth_2 = GetNumber(column_depth, AtLeast=1, AtMost=1, Maximum=1.797693135e+308, Minimum=-1.797693135e+308, TreeAccess=False)
column_width_2 = GetNumber(column_width, AtLeast=1, AtMost=1, Maximum=1.797693135e+308, Minimum=-1.797693135e+308, TreeAccess=False)
multiplication = Multiplication(A=wall_thickness_2, B="100")
multiplication_2 = Multiplication(A=column_width_2, B="100")
multiplication_3 = Multiplication(A=column_depth_2, B="100")
multiplication_4 = Multiplication(A=primary_beam_height_2, B="100")
multiplication_5 = Multiplication(A=primary_beam_width_2, B="100")
multiplication_6 = Multiplication(A=sec_beam_height_2, B="100")
multiplication_7 = Multiplication(A=sec_beam_width_2, B="100")

deflection_limit_choice = ClusterInput()

material_karamba_2 = Data(material_karamba)
plan_each_outline_2 = Data(plan_each_outline)
roof_step_height_2 = Number(roof_step_height)
plan_outline_2 = Data(plan_outline)
base_height_2 = Number(base_height)
grid_size_2 = Number(grid_size)

deflection_allowed_absolute_cm_2 = GetInteger(deflection_allowed_absolute_cm, AtLeast=1, AtMost=1, Maximum=2147483647, Minimum=-2147483648, TreeAccess=False)
deflection_allowed_length_x_2 = GetInteger(deflection_allowed_length_x, AtLeast=1, AtMost=1, Maximum=2147483647, Minimum=-2147483648, TreeAccess=False)
joint_stiffness_factor_2 = GetNumber(joint_stiffness_factor, AtLeast=1, AtMost=1, Maximum=1.797693135e+308, Minimum=-1.797693135e+308, TreeAccess=False)
deflection_limit_choice_2 = GetBoolean(deflection_limit_choice, AtLeast=1, AtMost=1, FalseValue="False", TreeAccess=False, TrueValue="True")
wall_thickness_3 = ClusterOutput(multiplication)
column_width_3 = ClusterOutput(multiplication_2)
column_depth_3 = ClusterOutput(multiplication_3)
primary_beam_height_3 = ClusterOutput(multiplication_4)
primary_beam_width_3 = ClusterOutput(multiplication_5)
sec_beam_height_3 = ClusterOutput(multiplication_6)
sec_beam_width_3 = ClusterOutput(multiplication_7)
line = ClusterInput()
line_2 = ClusterInput()

# ----
# Beam elements
# Primary + Secondary
sec_beam_height_4 = Data(multiplication_6)
sec_beam_width_4 = Data(multiplication_7)
primary_beam_height_4 = Data(multiplication_4)
primary_beam_width_4 = Data(multiplication_5)
expression = Expression(x=sec_beam_width_4, y=sec_beam_height_4, Expression="Sqrt(x²+y²)")
multiplication_8 = Multiplication(A=sec_beam_width_4, B="0.5")
multiplication_9 = Multiplication(A=sec_beam_height_4, B="0.5")
cross_section = CrossSectionKaramba3D(
    FamilyNameOfCrossSection="DefaultCroSec",
    NameOfCrossSection="Beam_Secondary_Cross_Section",
    Material=material_karamba_2,
    Height_cm=sec_beam_height_4,
    UpperFlangeWidth_cm=sec_beam_width_4,
    LowerFlangeWidth_cm=sec_beam_width_4,
    mode="Trapezoid")
multiplication_10 = Multiplication(A=expression, B="0.5")
cross_section_2 = CrossSectionKaramba3D(
    FamilyNameOfCrossSection="DefaultCroSec",
    NameOfCrossSection="Beam_Primary_Cross_Section",
    Material=material_karamba_2,
    Height_cm=primary_beam_height_4,
    UpperFlangeWidth_cm=primary_beam_width_4,
    LowerFlangeWidth_cm=primary_beam_width_4,
    mode="Trapezoid")
pt = ConstructPoint(XCoordinate=multiplication_10, YCoordinate=multiplication_9, ZCoordinate=multiplication_8)
line_3 = Line(line)
divlength = DivideLength(Curve=line_3, Length=grid_size_2)  # -> Points, Tangents, Parameters
multiplication_11 = Multiplication(A=pt, JointStiffnessFactor=joint_stiffness_factor_2)
line_4 = Line(line_2)
shatter = Shatter(Curve=graft(line_3), Parameters=divlength.Parameters)  # -> flatten(Segments)
panel = Panel("5,5,5")
rdlines = RemoveDuplicateLinesKaramba3D(Line=shatter, LimitDistance=0.005)  # -> OutLine, Info, Indexes
linetobeam = LineToBeamKaramba3D(
    Line=line_4,
    Identifier="secondary_beams",
    CrossSection=cross_section,
    New=True,
    Remove=True,
    LimitDistance_m=0.005,
    Bending=True,
    SetBucklingLength=True,
    ToPolylineMaxAngle=0.03,
    ToPolylineTolerance=0.01,
    ToPolylineMinEdgeLength=0.25)  # -> Element, Points, Info
beam_joints = BeamJointsKaramba3D(
    AtElementIdentifiers="secondary_beams",
    CtKNMAtStartingNode=Vector(0, 0, 0),
    CrKNmRadAtStartingNode=multiplication_11,
    CtKNMAtEndNode=Vector(0, 0, 0),
    CrKNmRadAtEndNode=multiplication_11,
    menu=[buttons(off, off, off, on, on, on), buttons(off, off, off, on, on, on)])
linetobeam_2 = LineToBeamKaramba3D(
    Line=rdlines.OutLine,
    Identifier="primary_beams",
    CrossSection=cross_section_2,
    New=True,
    Remove=True,
    LimitDistance_m=0.005,
    Bending=True,
    SetBucklingLength=True,
    ToPolylineMaxAngle=0.03,
    ToPolylineTolerance=0.01,
    ToPolylineMinEdgeLength=0.25)  # -> Element, Points, Info

# ----
# Loads
# Gravity
# Roof dead load
# Roof maintenance load
panel_2 = Panel("""LC01 Gravity (including roof panels)
LC02 Gravity + roof maintenance
LC03 Wind N
LC04 Wind NE
LC05 Wind E
LC06 Wind SE
LC07 Wind S
LC08 Wind SW
LC09 Wind W
LC10 Wind NW""")
panel_3 = Panel("""0
1""")
cull_i = CullIndex(List=panel_2, Indices=panel_3, Wrap=False)
panel_4 = Panel(cull_i)
item = ListItem(List=panel_2, Index="1", Wrap=True)
loads = LoadsKaramba3D(Vector=Vector(0, 0, -1), LCase=panel_2, mode="Gravity")
beam_loads = BeamLoadsKaramba3D(
    BeamIdentifier="secondary_beams",
    LoadCase=item,
    ForceVector="0,0,-1",
    TStart=0,
    TEnd=1,
    mode="Block",
    menu=[buttons(off, on, off)])
beam_loads_2 = BeamLoadsKaramba3D(
    BeamIdentifier="secondary_beams",
    LoadCase=panel_2,
    ForceVector="0,0,-0.5",
    TStart=0,
    TEnd=1,
    mode="Block",
    menu=[buttons(off, on, off)])

A = ClusterInput()
L = ClusterInput()
_0 = ClusterInput()

# ----
# Pop lines when equal to the numbers. This is to remove the 3 original lines. This is not parametric in regard to number of initial lines.
panel_5 = Panel("""2
3
4""")
equals = Equality(FirstNumber=A, SecondNumber=panel_5)  # -> Equality, Inequality
split = SplitList(List=L, Index="1")  # -> ListA, ListB
item_2 = ListItem(List=equals.Equality, Index=0, Wrap=True)  # -> Item, Item1, Item2
or = GateOr(A=item_2.Item, B=item_2.Item1, C=item_2.Item2)
filter = StreamFilter(Gate=or, Stream0=_0, Stream1=split.ListB)

# ----
# Columns
panel_6 = Panel("Column_Cross_Section")
column_width_4 = Data(multiplication_2)
column_depth_4 = Data(multiplication_3)
expression_2 = Expression(x=column_width_4, y=column_depth_4, Expression="Sqrt(x²+y²)")
multiplication_12 = Multiplication(A=column_depth_4, B="0.5")
cross_section_3 = CrossSectionKaramba3D(
    FamilyNameOfCrossSection="DefaultCroSec",
    NameOfCrossSection=panel_6,
    Material=material_karamba_2,
    Height_cm=column_depth_4,
    UpperFlangeWidth_cm=column_width_4,
    LowerFlangeWidth_cm=column_width_4,
    mode="Trapezoid")
multiplication_13 = Multiplication(A=column_width_4, B="0.5")
multiplication_14 = Multiplication(A=expression_2, B="0.5")
line_5 = Line(filter)
pt_2 = ConstructPoint(XCoordinate=multiplication_14, YCoordinate=multiplication_12, ZCoordinate=multiplication_13)
linetobeam_3 = LineToBeamKaramba3D(
    Line=line_5,
    Identifier="column",
    CrossSection=cross_section_3,
    New=True,
    Remove=True,
    LimitDistance_m=0.005,
    Bending=True,
    SetBucklingLength=True,
    ToPolylineMaxAngle=0.03,
    ToPolylineTolerance=0.01,
    ToPolylineMinEdgeLength=0.25)  # -> Element, Points, Info

karamba_secondary_beams = Data(linetobeam.Element)

# ----
# Wind load, kN per m2 facade in wind
# Wind Loads, 8 directions
# https://civilsguide.com/how-to-design-for-wind-loads-to-eurocode-1-1-4/
# 
# qp = 1.85 x 353 = 653 N/m2 (0.65 kN/m2)
# for each direction, the wind load per panel
panel_7 = Panel("-45")
vec = VectorXYZ(XComponent=0, YComponent="-1", ZComponent=0)  # -> Vector, Length
series = Series(Start=0, Step=panel_7, Count="8")
Z = UnitZ(Factor=base_height_2)
rotate = Rotate(Geometry=vec.Vector, Angle=degrees(series), Plane=PlaneXY(0, 0, 0))  # -> Geometry, Transform
extr = Extrude(Base=plan_outline_2, Direction=Z)
debrep = DeconstructBrep(Brep=extr)  # -> Faces, Edges, Vertices
xy = XYPlane(Origin=Point(0, 0, 0))
number_slider = Slider(80, range=0..100)
evalsrf = EvaluateSurface(Surface=reparameterize(debrep.Faces), Point="0.5,0.5")  # -> Point, Normal, UDirection, VDirection, Frame
angle = Angle(VectorA=graft(evalsrf.Normal), VectorB=rotate.Geometry, Plane=xy)  # -> Angle, Reflex
deg = Degrees(Radians=angle.Reflex)
deg_2 = Degrees(Radians=angle.Angle)
angle_2 = Angle(VectorA=graft(evalsrf.Normal), VectorB=rotate.Geometry, Plane=xy)  # -> Angle, Reflex
vdisex = VectorDisplayEx(Point=evalsrf.Point, Vector=evalsrf.Normal, Colour=RGB(0, 0, 0), Width=2)
area = Area(Geometry=debrep.Faces)  # -> Area, Centroid
cos = Cosine(Value=angle_2.Angle)
smaller = SmallerThan(FirstNumber=deg_2, SecondNumber=number_slider)  # -> SmallerThan, OrEqualTo
smaller_2 = SmallerThan(FirstNumber=deg, SecondNumber=number_slider)  # -> SmallerThan, OrEqualTo
multiplication_15 = Multiplication(A=graft(area.Area), B=cos)
or_2 = GateOr(A=smaller.OrEqualTo, B=smaller_2.OrEqualTo)
series_2 = Series(Start=0, Step=1, Count=8)
cull = CullPattern(List=series_2, CullPattern=invert(or_2))
secondary_beams = Data(line_4)
replace = ReplaceItems(List=multiplication_15, Item="0", Indices=cull, Wrap=False)
flip = FlipMatrix(Data=replace)
vec_2 = Vector(rotate.Geometry)
multiplication_16 = Multiplication(A=base_height_2, B=-0.5)
Z_2 = UnitZ(Factor=multiplication_16)
midpt = CurveMiddle(Curve=secondary_beams)
multiplication_17 = Multiplication(A=graft(vec_2), B=flip)  # -> simplify(Result)
equals_2 = Equality(FirstNumber=multiplication_17, SecondNumber="0")  # -> Equality, Inequality
move = Move(Geometry=midpt, Motion=Z_2)  # -> Geometry, Transform
cull_2 = CullPattern(List=debrep.Faces, CullPattern=equals_2.Inequality)  # -> simplify(List)
graft = GraftTree(Tree=cull_2, IncludeEmptyLists=True, IncludeNullItems=True)
incurve = PointInCurve(Point=move.Geometry, Curve=graft)  # -> Relationship, Point
match = MatchTree(Tree=incurve.Relationship, Guide=graft)
equals_3 = Equality(FirstNumber=match, SecondNumber="2")  # -> Equality, Inequality
lng = ListLength(List=karamba_secondary_beams)
series_3 = Series(Start=0, Step=1, Count=lng)
panel_8 = Panel(panel_4)
cull_3 = CullPattern(List=series_3, CullPattern=equals_3.Equality)  # -> simplify(List)
match_2 = MatchTree(Tree=cull_3, Guide=graft)
trim = TrimTree(Tree=match_2, Depth=1)
pt_3 = ConstructPoint(XCoordinate=trim, YCoordinate=0, ZCoordinate=0)
cullpt = CullDuplicates(Points=pt_3, Tolerance=0.1, CullMode=3)  # -> Points, Indices, Valence
pdecon = Deconstruct(Point=cullpt.Points)  # -> XComponent, YComponent, ZComponent
number_slider_2 = Slider(0.65, range=0..3)  # "kN/m2"
item_3 = ListItem(List=karamba_secondary_beams, Index=pdecon.XComponent, Wrap=True)
len = Length(Curve=line_4)
item_4 = ListItem(List=len, Index=pdecon.XComponent, Wrap=True)
ma = MassAddition(Input=item_4)  # -> Result, PartialResults
division = Division(A=multiplication_17, B=graft(ma.Result))
multiplication_18 = Multiplication(A=number_slider_2, B=division)
beam_loads_3 = BeamLoadsKaramba3D(
    BeamIdentifier=simplify(item_3),
    LoadCase=simplify(graft(panel_8)),
    ForceVector=simplify(multiplication_18),
    TStart=0,
    TEnd=1,
    mode="Block",
    menu=[buttons(off, on, off)])

L_2 = ClusterOutput(rdlines.OutLine)
C = ClusterInput()

# ----
# To check which points are activated for each wind direction
number_slider_3 = Slider(0, range=0..7)
item_5 = ListItem(List=midpt, Index=pdecon.XComponent, Wrap=True)
branch = TreeBranch(Tree=simplify(cull_2), Path=number_slider_3, MaintainPaths=True)
branch_2 = TreeBranch(Tree=simplify(item_5), Path=number_slider_3, MaintainPaths=True)

T = ClusterInput()

multiplication_19 = Multiplication(A=pt_2, JointStiffnessFactor=joint_stiffness_factor_2)
panel_9 = Panel("800,800,800")
beam_joints_2 = BeamJointsKaramba3D(
    AtElementIdentifiers="column",
    CtKNMAtStartingNode=Vector(0, 0, 0),
    CrKNmRadAtStartingNode=multiplication_19,
    CtKNMAtEndNode=Vector(0, 0, 0),
    CrKNmRadAtEndNode=multiplication_19,
    menu=[buttons(off, off, off, on, on, on), buttons(off, off, off, on, on, on)])

clean = CleanTree(RemoveNulls=True, RemoveInvalid=True, RemoveEmpty=True, Tree=T)

# ----
# Shear Walls
divlength_2 = DivideLength(Curve=C, Length=grid_size_2)  # -> Points, Tangents, Parameters
mesh_breps = MeshBrepsKaramba3D(
    Brep=clean,
    InclusionPoints=flatten(divlength_2.Points),
    MeshResolution=0.25,
    EdgeRefinementFactor=0.67,
    PointReduction=False,
    SmoothingStepSize=0,
    SmoothingIterations=5)  # -> Mesh, Info
cross_section_4 = CrossSectionKaramba3D(
    FamilyNameOfCrossSection="DefaultCroSec",
    NameOfCrossSection="wall_cross_section",
    Material=material_karamba_2,
    Height_cm=multiplication,
    mode="Shell - Const")
meshtoshell = MeshToShellKaramba3D(Mesh=mesh_breps.Mesh, Identifier="shear_walls", CrossSection=cross_section_4, LimitDistance_m=0.005)  # -> Element, Points, Info

# ----
# Supports
# Support conditions from columns and shear walls
debrep_2 = DeconstructBrep(Brep=clean)  # -> Faces, Edges, simplify(Vertices)
end = EndPoints(Curve=line_5)  # -> Start, End
item_6 = ListItem(List=debrep_2.Vertices, Index=0, Wrap=True)  # -> Item, Item1
rdpoints = RemoveDuplicatePointsKaramba3D(Point=[item_6.Item, item_6.Item1, end.Start], LimitDistance=0.005)  # -> OutPoint, Info, Indexes
supp = SupportKaramba3D(PosInd=rdpoints.OutPoint, menu=[buttons(on, on, on, off, off, on)])

merge = Merge(Data1=loads, Data2=beam_loads_2, Data3=beam_loads_3, Data4=beam_loads)
assemble = AssembleModelKaramba3D(
    Elem=flatten([linetobeam_3.Element, linetobeam_2.Element, linetobeam.Element, meshtoshell.Element]),
    Support=flatten(supp),
    Load=flatten(merge),
    Joint=flatten([beam_joints, beam_joints_2]),
    LimitDistance_m=0.005)  # -> Model, Info, Mass_kg, CenterOfGravity, LoadCaseNames
allowed_support_connections = ClusterInput()
primary_beams = ClusterInput()
disassemble = DisassembleModelKaramba3D(Model=assemble.Model)  # -> Model, Point, Beam, Shell, Support, Load, Line, Mesh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
analyze = AnalyzeKaramba3D(Model=assemble.Model)  # -> CalculatedModel, MaximumDisplacement_cm, ResultingForceOfGravity_kN, ElasticEnergyChange_kNm

# ----
# This here finds the load case with the maximum translation (displacement). Then uses that load as the input for the column analysis.
# Squared sum worst case displacement
# Single worst case displacement
primary_beam_points = Data(linetobeam_2.Points)
panel_11 = Panel(panel_2)
# Worst Load case
nodedisp = NodalDisplacementsKaramba3D(AnalyzedModel=analyze.CalculatedModel, PositionsIndexes=primary_beam_points, LoadCase=panel_11)  # -> AnalyzedModel, NodalTranslations_m, NodalRotations_rad
sort = SortList(Keys=nodedisp.NodalTranslations_m)  # -> Keys, ValuesA
item_7 = ListItem(List=sort.Keys, Index="-1", Wrap=True)
lng_2 = ListLength(List=flatten(item_7))
multiplication_20 = Multiplication(A=nodedisp.NodalTranslations_m, B=nodedisp.NodalTranslations_m)
series_4 = Series(Start=0, Step=1, Count=lng_2)
sort_2 = SortList(Keys=flatten(item_7), ValuesA=series_4)  # -> Keys, ValuesA
ma_2 = MassAddition(Input=multiplication_20)  # -> Result, PartialResults
sort_3 = SortList(Keys=flatten(ma_2.Result), ValuesA=series_4)  # -> flatten(Keys), ValuesA
use_single_worst_case_instead_of_sum_squ = BooleanToggle(False)  # "Use single worst case instead of sum squared"
item_8 = ListItem(List=sort_2.ValuesA, Index="-1", Wrap=True)
item_9 = ListItem(List=sort_3.ValuesA, Index="-1", Wrap=True)
filter_2 = StreamFilter(Gate=use_single_worst_case_instead_of_sum_squ, Stream0=item_9, Stream1=item_8)
item_10 = ListItem(List=panel_11, Index=filter_2, Wrap=True)

allowed_support_connections_2 = Point(allowed_support_connections)
base_height_3 = Data(base_height_2)
plan_each_outline_3 = Data(plan_each_outline_2)
primary_beams_2 = Line(primary_beams)
grid_size_3 = Number(grid_size_2)

disp = ClusterOutput(analyze.MaximumDisplacement_cm)

list = ValueList({"LC01 Gravity (including roof panels)": 0, "LC02 Gravity + roof maintenance": 1, "LC03 Wind N": 2, "LC04 Wind NE": 3, "LC05 Wind E": 4, "LC06 Wind SE": 5, "LC07 Wind S": 6, "LC08 Wind SW": 7, "LC09 Wind W": 8, "LC10 Wind NW": 9}, selected="LC02 Gravity + roof maintenance")
modelview = ModelViewKaramba3D(Model=analyze.CalculatedModel, ResultFactors=1, ResultCase=list)  # -> Model, DeformedMesh, DeformedAxes, DeformedModel
mesh = Mesh(modelview.DeformedMesh)
beamview = BeamViewKaramba3D(Model=modelview.Model)  # -> Model, MeshesOfRenderedBeams, DeformedBeamAxes, LegendColors, LegendTags
legend = Legend(Colour=beamview.LegendColors, Tags=beamview.LegendTags, LegendType=1)
shellview = ShellViewKaramba3D(Model=modelview.Model, IndexOfLayer=0)  # -> Model, MeshesOfRenderedShells, LegendColors, LegendTags
legend_2 = Legend(Colour=shellview.LegendColors, Tags=shellview.LegendTags, LegendType=1)

# ----
# Finding direction of primary beams
panel_12 = Panel("0.5")
pframe = PerpFrame(Curve=primary_beams_2, Parameter=panel_12)
devec = DeconstructVector(Vector=unitize(pframe))  # -> XComponent, YComponent, ZComponent
abs = Absolute(Value=devec.XComponent)
abs_2 = Absolute(Value=devec.YComponent)
equals_4 = Equality(FirstNumber=abs, SecondNumber="1")  # -> Equality, Inequality
equals_5 = Equality(FirstNumber="1", SecondNumber=abs_2)  # -> Equality, Inequality
cull_4 = CullPattern(List=primary_beams_2, CullPattern=equals_4.Equality)
cull_5 = CullPattern(List=primary_beams_2, CullPattern=equals_5.Equality)

elemquery = ElementQueryKaramba3D(Model=analyze.CalculatedModel, ElementsIdentifiers=graft(["primary_beams", "shear_walls", "column", "secondary_beams"]))  # -> Model, Mass_kg, Area_m2, Volume_m3, Meshes
allowed_support_connections_3 = ClusterInput()
mass = ClusterOutput(elemquery.Mass_kg)
meshes = ClusterOutput(elemquery.Meshes)

# ----
# Max disp point + Basic column
# This finds the point with the maximum displacement.
allowed_support_connections_4 = Point(allowed_support_connections_3)
nodedisp_2 = NodalDisplacementsKaramba3D(AnalyzedModel=analyze.CalculatedModel, PositionsIndexes=allowed_support_connections_4, LoadCase=item_10)  # -> AnalyzedModel, NodalTranslations_m, NodalRotations_rad
pt_4 = Point(primary_beam_points)
move_2 = Move(Geometry=pt_4, Motion=nodedisp_2.NodalTranslations_m)  # -> Geometry, Transform
vec2pt = Vector2Pt(PointA="0,0,0", PointB=nodedisp_2.NodalTranslations_m, Unitize=False)  # -> Vector, Length
lng_3 = ListLength(List=vec2pt.Length)
series_5 = Series(Start=0, Step=1, Count=lng_3)
sort_4 = SortList(Keys=vec2pt.Length, ValuesA=series_5)  # -> Keys, ValuesA
item_11 = ListItem(List=sort_4.ValuesA, Index="-1", Wrap=True)
height = Multiplication(Height=base_height_2, B=-1)
item_12 = ListItem(List=allowed_support_connections_4, Index=item_11, Wrap=True)
cps = ClosestPointsKaramba3D(Point=item_12, Cloud=allowed_support_connections_4, NumberOfNeighbors=1, LimitDistance=-1)  # -> Points, Index, Distance
Z_3 = UnitZ(Factor=height)
move_3 = Move(Geometry=cps.Points, Motion=Z_3)  # -> Geometry, Transform
panel_13 = Panel("A simple vertical column")
ln = Line(StartPoint=move_3.Geometry, EndPoint=cps.Points)

# ----
# Shear Walls
# Creating module shear walls
X = UnitX(Factor=1)
Y = UnitY(Factor=1)
multiplication_21 = Multiplication(BaseHeight=base_height_3, B=-1)
multiplication_22 = Multiplication(A=[X, Y], B=grid_size_3)
Z_4 = UnitZ(Factor=multiplication_21)
addition = Addition(A=multiplication_22, B=Z_4)
move_4 = Move(Geometry=cps.Points, Motion=addition)  # -> Geometry, Transform
yz = YZPlane(Origin=cps.Points)
xz = XZPlane(Origin=cps.Points)
ln_2 = Line(StartPoint=move_4.Geometry, EndPoint=cps.Points)
rec_2pt = Rectangle2Pt(Plane=[xz, yz], PointA=cps.Points, PointB=move_4.Geometry, Radius=0)  # -> Rectangle, Length
item_13 = ListItem(List=move_4.Geometry, Index=0, Wrap=True)  # -> Item, Item1
item_14 = ListItem(List=rec_2pt.Rectangle, Index=0, Wrap=True)  # -> Item, Item1

mesh_2 = Mesh([beamview.MeshesOfRenderedBeams, shellview.MeshesOfRenderedShells])
mesh_output = ClusterOutput(mesh_2)

divlength_3 = DivideLength(Curve=cull_4, Length=grid_size_3)  # -> Points, Tangents, Parameters
cp = ClosestPoint(Point=allowed_support_connections_2, Cloud=divlength_3.Points)  # -> ClosestPoint, CPIndex, Distance
smaller_3 = SmallerThan(FirstNumber=cp.Distance, SecondNumber="0.1")  # -> SmallerThan, OrEqualTo
cull_6 = CullPattern(List=cp.ClosestPoint, CullPattern=smaller_3.SmallerThan)
rdpoints_2 = RemoveDuplicatePointsKaramba3D(Point=flatten(cull_6), LimitDistance=0.005)  # -> OutPoint, Info, Indexes
vec2pt_2 = Vector2Pt(PointA=cps.Points, PointB=rdpoints_2.OutPoint, Unitize=False)  # -> Vector, Length
move_5 = Move(Geometry=item_14.Item, Motion=vec2pt_2.Vector)  # -> Geometry, Transform
# These filter out only valid walls that connect to primary beams only
debrep_3 = DeconstructBrep(Brep=graft(move_5.Geometry))  # -> Faces, Edges, simplify(Vertices)
pdecon_2 = Deconstruct(Point=debrep_3.Vertices)  # -> XComponent, YComponent, ZComponent
equals_6 = Equality(FirstNumber=pdecon_2.ZComponent, SecondNumber=base_height_3)  # -> Equality, Inequality
cull_7 = CullPattern(List=debrep_3.Vertices, CullPattern=equals_6.Equality)
item_15 = ListItem(List=cull_7, Index=0, Wrap=True)  # -> Item, Item1
pt_5 = Point(allowed_support_connections_2)
cp_2 = ClosestPoint(Point=item_15.Item1, Cloud=allowed_support_connections_2)  # -> ClosestPoint, CPIndex, Distance
cp_3 = ClosestPoint(Point=item_15.Item, Cloud=allowed_support_connections_2)  # -> ClosestPoint, CPIndex, Distance
multiplication_23 = Multiplication(GridDim=grid_size_3, B="0.2")
smaller_4 = SmallerThan(FirstNumber=cp_3.Distance, SecondNumber=multiplication_23)  # -> SmallerThan, OrEqualTo
smaller_5 = SmallerThan(FirstNumber=cp_2.Distance, SecondNumber=multiplication_23)  # -> SmallerThan, OrEqualTo
and = GateAnd(A=smaller_5.SmallerThan, B=smaller_4.SmallerThan)
cull_8 = CullPattern(List=move_5.Geometry, CullPattern=flatten(and))

divlength_4 = DivideLength(Curve=cull_5, Length=grid_size_3)  # -> Points, Tangents, Parameters
cp_4 = ClosestPoint(Point=allowed_support_connections_2, Cloud=divlength_4.Points)  # -> ClosestPoint, CPIndex, Distance
smaller_6 = SmallerThan(FirstNumber=cp_4.Distance, SecondNumber="0.1")  # -> SmallerThan, OrEqualTo
cull_9 = CullPattern(List=cp_4.ClosestPoint, CullPattern=smaller_6.SmallerThan)
rdpoints_3 = RemoveDuplicatePointsKaramba3D(Point=flatten(cull_9), LimitDistance=0.005)  # -> OutPoint, Info, Indexes
vec2pt_3 = Vector2Pt(PointA=cps.Points, PointB=rdpoints_3.OutPoint, Unitize=False)  # -> Vector, Length
move_6 = Move(Geometry=item_14.Item1, Motion=vec2pt_3.Vector)  # -> Geometry, Transform
debrep_4 = DeconstructBrep(Brep=graft(move_6.Geometry))  # -> Faces, Edges, simplify(Vertices)
pdecon_3 = Deconstruct(Point=debrep_4.Vertices)  # -> XComponent, YComponent, ZComponent
equals_7 = Equality(FirstNumber=pdecon_3.ZComponent, SecondNumber=base_height_3)  # -> Equality, Inequality
cull_10 = CullPattern(List=debrep_4.Vertices, CullPattern=equals_7.Equality)
item_16 = ListItem(List=cull_10, Index=0, Wrap=True)  # -> Item, Item1
pt_6 = Point(allowed_support_connections_2)
cp_5 = ClosestPoint(Point=item_16.Item1, Cloud=allowed_support_connections_2)  # -> ClosestPoint, CPIndex, Distance
cp_6 = ClosestPoint(Point=item_16.Item, Cloud=allowed_support_connections_2)  # -> ClosestPoint, CPIndex, Distance
multiplication_24 = Multiplication(GridDim=grid_size_3, B="0.2")
smaller_7 = SmallerThan(FirstNumber=cp_6.Distance, SecondNumber=multiplication_24)  # -> SmallerThan, OrEqualTo
smaller_8 = SmallerThan(FirstNumber=cp_5.Distance, SecondNumber=multiplication_24)  # -> SmallerThan, OrEqualTo
and_2 = GateAnd(A=smaller_8.SmallerThan, B=smaller_7.SmallerThan)
cull_11 = CullPattern(List=move_6.Geometry, CullPattern=flatten(and_2))

# ----
# This creates 3 columns, one in each displacement direction. Only one valid column is picked in the end.
# Checking that they are not inside of a floor plan area. Then removing those that are and sorting the lists based on the original deformation and picking the direction with the largest deformation from the remaining points.
# Creating 3 lines, in x y and z
node_translations_from_deformation = Data(nodedisp_2.NodalTranslations_m)
plan_each_outline_4 = Data(plan_each_outline_2)
item_17 = ListItem(List=node_translations_from_deformation, Index=item_11, Wrap=True)
devec_2 = DeconstructVector(Vector=unitize(item_17))  # -> XComponent, YComponent, ZComponent
# Slanted structural columns
abs_3 = Absolute(Value=[devec_2.XComponent, devec_2.YComponent, devec_2.ZComponent])
Z_5 = UnitZ(Factor=devec_2.ZComponent)  # -> expr("x*0", unitize(UnitVector))
X_2 = UnitX(Factor=devec_2.XComponent)  # -> unitize(UnitVector)
Y_2 = UnitY(Factor=devec_2.YComponent)  # -> unitize(UnitVector)
multiplication_25 = Multiplication(BaseHeight=base_height_2, B=-1)
multiplication_26 = Multiplication(A=[X_2, Y_2, Z_5], B=Slider(2, range=0..5))
Z_6 = UnitZ(Factor=multiplication_25)
addition_2 = Addition(A=multiplication_26, B=Z_6)
move_7 = Move(Geometry=cps.Points, Motion=addition_2)  # -> Geometry, Transform
ln_3 = Line(StartPoint=move_7.Geometry, EndPoint=cps.Points)
midpt_2 = CurveMiddle(Curve=ln_3)
incurve_2 = PointInCurve(Point=midpt_2, Curve=graft(plan_each_outline_4))  # -> Relationship, Point
equals_8 = Equality(FirstNumber=incurve_2.Relationship, SecondNumber="2")  # -> Equality, Inequality
flip_2 = FlipMatrix(Data=equals_8.Equality)
ma_3 = MassAddition(Input=flip_2)  # -> Result, PartialResults
smaller_9 = SmallerThan(FirstNumber=flatten(ma_3.Result), SecondNumber="1")  # -> SmallerThan, OrEqualTo
lng_4 = ListLength(List=smaller_9.SmallerThan)
series_6 = Series(Start=0, Step=1, Count=lng_4)
cull_12 = CullPattern(List=series_6, CullPattern=invert(smaller_9.SmallerThan))
replace_2 = ReplaceItems(List=abs_3, Indices=cull_12, Wrap=False)
replace_3 = ReplaceItems(List=ln_3, Indices=cull_12, Wrap=False)
sort_5 = SortList(Keys=replace_2, ValuesA=replace_3)  # -> Keys, ValuesA
item_18 = ListItem(List=sort_5.ValuesA, Index="-1", Wrap=True)

straight_columns_only = BooleanToggle(True)
straight_columns_only_not_in_use = GetBoolean(straight_columns_only, AtLeast=0, AtMost=1, FalseValue="False", TreeAccess=False, TrueValue="True")

# ----
# Toggle to include or exclude slanted columns
filter_3 = StreamFilter(Gate=straight_columns_only_not_in_use, Stream0=item_18, Stream1=ln)

# ----
# New toggle for disabling walls
filter_4 = StreamFilter(Gate=0)
previous_wall_locations = ClusterInput()

# ----
# New Columns
# This finds the primary direction of the displacement. If it is Z (vertical) then it will prioritize placing a column. If it is X or Y then it will place a shear wall in the appropriate direction.
# New Walls
# This checks max displacement direction
# Picking wall or column. Filtering results to keep the categories separate.
# Taking the new column/wall and removing the attachment points from the current list of available attachment points. The ensures that columns and walls can only be placed once at each grid node.
# This takes in the priority order G, but also checks that there are corrosponding valid inputs. For instance if there is no X walls, then it will choose the next best option which may be a column.
area_2 = Area(Geometry=cull_8)  # -> Area, Centroid
area_3 = Area(Geometry=cull_11)  # -> Area, Centroid
item_19 = ListItem(List=nodedisp_2.NodalTranslations_m, Index=item_11, Wrap=True)
devec_3 = DeconstructVector(Vector=unitize(item_19))  # -> XComponent, YComponent, ZComponent
cp_7 = ClosestPoint(Point=cps.Points, Cloud=area_3.Centroid)  # -> ClosestPoint, CPIndex, Distance
cp_8 = ClosestPoint(Point=cps.Points, Cloud=area_2.Centroid)  # -> ClosestPoint, CPIndex, Distance
abs_4 = Absolute(Value=[devec_3.XComponent, devec_3.YComponent, devec_3.ZComponent])
item_20 = ListItem(List=cull_11, Index=cp_7.CPIndex, Wrap=True)
series_7 = Series(Start=0, Step=1, Count="3")
item_21 = ListItem(List=cull_8, Index=cp_8.CPIndex, Wrap=True)
sort_6 = SortList(Keys=abs_4, ValuesA=series_7)  # -> Keys, ValuesA
null = NullItem(Item=ln)  # -> NullFlags, InvalidFlags, Description
null_2 = NullItem(Item=cull_8)  # -> NullFlags, InvalidFlags, Description
null_3 = NullItem(Item=cull_11)  # -> NullFlags, InvalidFlags, Description
ma_4 = MassAddition(Input=null.NullFlags)  # -> Result, PartialResults
ma_5 = MassAddition(Input=null_2.NullFlags)  # -> Result, PartialResults
ma_6 = MassAddition(Input=null_3.NullFlags)  # -> Result, PartialResults
equals_9 = Equality(FirstNumber=ma_5.Result, SecondNumber="1")  # -> Equality, Inequality
equals_10 = Equality(FirstNumber=ma_4.Result, SecondNumber="1")  # -> Equality, Inequality
equals_11 = Equality(FirstNumber=ma_6.Result, SecondNumber="1")  # -> Equality, Inequality
python = GhPythonScript(
    G=reverse(sort_6.ValuesA),
    x_available=equals_9.Inequality,
    y_available=equals_11.Inequality,
    z_available=equals_10.Inequality)  # -> out, a; inputs G: list of Int32, x_available: Boolean, y_available: Boolean, z_available: Boolean
# ---------- python: Python ----------
__author__ = "sebas"
__version__ = "2022.10.19"

import rhinoscriptsyntax as rs

list = []
list.append(bool(x_available))
list.append(bool(y_available))
list.append(bool(z_available))

if list[G[0]]:
    print('first item')
    a = G[0]

elif list[G[1]]:
    print('second item')
    a = G[1]

elif list[G[2]]:
    print('third item')
    a = G[2]

print(list)
print(a)
# ---------- end python ----------
filter_5 = StreamFilter(Gate=python.a, Stream0=item_21, Stream1=item_20, Stream2=ln)
equals_12 = Equality(FirstNumber=python.a, SecondNumber="2")  # -> Equality, Inequality
gate = StreamGate(Stream=filter_5, Gate=equals_12.Equality)  # -> Target0, Target1
debrep_5 = DeconstructBrep(Brep=gate.Target0)  # -> Faces, Edges, Vertices
end_2 = EndPoints(Curve=gate.Target1)  # -> Start, End
item_22 = ListItem(List=debrep_5.Vertices, Index=0, Wrap=True)  # -> Item, Item1, Item2, Item3
cp_9 = ClosestPoint(Point=flatten(end_2.Start), Cloud=flatten(allowed_support_connections_4))  # -> ClosestPoint, CPIndex, Distance
cp_10 = ClosestPoint(Point=flatten([item_22.Item2, item_22.Item3]), Cloud=flatten(allowed_support_connections_4))  # -> ClosestPoint, CPIndex, Distance
filter_6 = StreamFilter(Gate=equals_12.Equality, Stream0=cp_10.CPIndex, Stream1=cp_9.CPIndex)
merge_2 = Merge(Data1=line_5, Data2=gate.Target1)  # -> flatten(Result)
merge_3 = Merge(Data1=previous_wall_locations, Data2=gate.Target0)  # -> flatten(Result)
line_6 = Line(flatten(merge_2))
cull_i_2 = CullIndex(List=allowed_support_connections_4, Indices=filter_6, Wrap=True)

# ----
# Exit Condition
# (Deflection)
primary_beams_3 = ClusterInput()
primary_beams_4 = Line(primary_beams_3)
len_2 = Length(Curve=primary_beams_4)  # -> flatten(Length)
python_2 = GhPythonScript(lengths=len_2)  # -> out, max_length; inputs lengths: list
# ---------- python_2: Python ----------
__author__ = "sebas"
__version__ = "2022.10.18"

import rhinoscriptsyntax as rs


max_length = max(lengths)
# ---------- end python_2 ----------
multiplication_27 = Multiplication(A=python_2.max_length, B="100")
karamba_disp = Data(analyze.MaximumDisplacement_cm)
division_2 = Division(Length=multiplication_27, AllowedDeflectionLX=deflection_allowed_length_x_2)
allowed_deflection_absolute_cm = Data(deflection_allowed_absolute_cm_2)
python_3 = GhPythonScript(x=karamba_disp)  # -> out, max_x; inputs x: list
# ---------- python_3: Python ----------
__author__ = "sebas"
__version__ = "2022.10.31"

import rhinoscriptsyntax as rs


max_x = max(x)
# ---------- end python_3 ----------
smaller_10 = SmallerThan(FirstNumber=karamba_disp, SecondNumber=division_2)  # -> SmallerThan, OrEqualTo
smaller_11 = SmallerThan(FirstNumber=python_3.max_x, SecondNumber=allowed_deflection_absolute_cm)  # -> SmallerThan, OrEqualTo
L_3 = ClusterInput()
ma_7 = MassAddition(Input=smaller_10.SmallerThan)  # -> Result, PartialResults
lng_5 = ListLength(List=karamba_disp)
lng_6 = ListLength(List=L_3)
equals_13 = Equality(FirstNumber=lng_6, SecondNumber="1")  # -> Equality, Inequality
equals_14 = Equality(FirstNumber=ma_7.Result, SecondNumber=lng_5)  # -> Equality, Inequality
filter_7 = StreamFilter(DeflectionLimitChoice=deflection_limit_choice_2, Stream0=smaller_11.SmallerThan, Stream1=equals_14.Equality)
pt_7 = Point(Point(0, 0, 0))
or_3 = GateOr(A=equals_13.Equality, B=filter_7)
filter_8 = StreamFilter(Gate=or_3, Stream0=cull_i_2, Stream1=pt_7)
allowable_support_connections = ClusterOutput(filter_8)
exit_condition_trigger = ClusterOutput(or_3)

new_walls = ClusterOutput(merge_3)
new_line_columns = ClusterOutput(line_6)
